# Grasshopper definition Geometry_109.gh (Grasshopper 1.0.7)

panel = Panel("C:\Users\khong\OneDrive\Documents\MIDP\Grasshopper\Saved_Hand_Sizes\thomas.txt")
panel_2 = Panel("C:\Users\Thomas\OneDrive\Documents\MIDP\Grasshopper\data_output.txt")
toggle = BooleanToggle(False)
file = ReadFile(File=panel, PerLineParse=True)
file_2 = ReadFile(File=panel_2, PerLineParse=True)
merge = Merge(Data1=file, Data2=file_2)
item = ListItem(List=merge, Index=Slider(0, range=0..4), Wrap=toggle)
item_2 = ListItem(List=merge, Index=Slider(3, range=0..4), Wrap=toggle)
item_3 = ListItem(List=merge, Index=Slider(4, range=0..4), Wrap=toggle)
item_4 = ListItem(List=merge, Index=Slider(1, range=0..4), Wrap=toggle)
item_5 = ListItem(List=merge, Index=Slider(2, range=0..4), Wrap=toggle)
item_6 = ListItem(List=merge, Index=Slider(5, range=0..7), Wrap=toggle)
item_7 = ListItem(List=merge, Index=Slider(6, range=0..7), Wrap=toggle)
item_8 = ListItem(List=merge, Index=Slider(7, range=0..7), Wrap=toggle)
merge_2 = Merge(Data1=item, Data2=item_4, Data3=item_5, Data4=item_2, Data5=item_3, Data6=item_6, Data7=item_7, Data8=item_8)
panel_3 = Panel(merge_2)
number_slider = Slider(90, range=60..110)
# Palm Length
number_slider_2 = Slider(72, range=60..90)
number_slider_3 = Slider(103, range=55..145)
# Index & Middle Finger Length
number_slider_4 = Slider(97, range=55..125)
# Ring & Small Finger Length
number_slider_5 = Slider(95, range=55..125)
# Palm Width
number_slider_6 = Slider(73, range=55..125)
# Thumb Length
number_slider_7 = Slider(60, range=40..80)
# Palm Width
# Palm Length
number_slider_8 = Slider(0, range=-15..15)
# Index & Middle Finger Length
# Ring & Small Finger Length
number_slider_9 = Slider(0, range=-15..15)
# Thumb Length
number_slider_10 = Slider(0, range=-15..15)
addition = Addition(A=item_6, B=item_8)
addition_2 = Addition(A=item_4, B=item_5)
division = Division(A=addition, B=2)
addition_3 = Addition(A=item_7, B=number_slider_8)
division_2 = Division(A=addition_2, B=2)
addition_4 = Addition(A=item, B=number_slider_10)
addition_5 = Addition(A=division, B=Slider(0, range=-15..15))
addition_6 = Addition(A=division_2, B=number_slider_9)
dom = ConstructDomain(DomainStart=-1, DomainEnd=1)
dom_2 = ConstructDomain(DomainStart=Slider(58, range=0..100), DomainEnd=Slider(100, range=0..110))
dom_3 = ConstructDomain(DomainStart=-1, DomainEnd=1)
dom_4 = ConstructDomain(DomainStart=Slider(70, range=0..100), DomainEnd=Slider(110, range=0..110))
dom_5 = ConstructDomain(DomainStart=-1, DomainEnd=1)
dom_6 = ConstructDomain(DomainStart=Slider(40, range=0..100), DomainEnd=Slider(80, range=0..100))
dom_7 = ConstructDomain(DomainStart=-1, DomainEnd=1)
dom_8 = ConstructDomain(DomainStart=Slider(55, range=0..100), DomainEnd=Slider(140, range=0..200))
remap = RemapNumbers(Value=addition_5, Source=dom_2, Target=dom)  # -> Mapped, flatten(Clipped)
remap_2 = RemapNumbers(Value=addition_3, Source=dom_4, Target=dom_3)  # -> Mapped, flatten(Clipped)
remap_3 = RemapNumbers(Value=addition_4, Source=dom_6, Target=dom_5)  # -> Mapped, flatten(Clipped)
remap_4 = RemapNumbers(Value=addition_6, Source=dom_8, Target=dom_7)  # -> Mapped, flatten(Clipped)
panel_4 = Panel(remap.Clipped)
panel_5 = Panel(remap_2.Clipped)
panel_6 = Panel(remap_4.Clipped)
panel_7 = Panel(remap_3.Clipped)
# Central Plane Z Height
# Central Plane Tilt Angle
# Button length
smooth = SmoothNumbers(Numbers=remap_4.Clipped, SmoothDelay=2000)
# Button Width
# Thumb Rest Protrusion
smooth_2 = SmoothNumbers(Numbers=remap_2.Clipped, SmoothDelay=2000)
# Thumb Parameter
smooth_3 = SmoothNumbers(Numbers=remap_3.Clipped, SmoothDelay=2000)
# Palm Rest Protrusion
# Central Plane Z Height
smooth_4 = SmoothNumbers(Numbers=remap.Clipped, SmoothDelay=2000)
multiplication = Multiplication(A=remap.Clipped, B=Slider(0.1, range=0..1))
merge_3 = Merge(Data1=remap_4.Clipped, Data2=remap.Clipped)
avr = Average(Input=merge_3)

# ---- group: Origin
Z = UnitZ(Factor=1)
pt = ConstructPoint(XCoordinate=Slider(0, range=-30..30), YCoordinate=Slider(0, range=-50..75), ZCoordinate=Slider(0, range=0..45))
pl = PlaneNormal(Origin=pt, ZAxis=Z)

# ----
multiplication_2 = Multiplication(A=avr, B=Slider(9, range=0..9))
multiplication_3 = Multiplication(A=remap_4.Clipped, B=Slider(0.08, range=0..1))
multiplication_4 = Multiplication(A=remap_3.Clipped, B=Slider(15, range=0..100))
addition_7 = Addition(A=Slider(49.259, range=0..65), B=multiplication_2)
addition_8 = Addition(A=Slider(-0.3, range=-1.57..1.57), B=multiplication_3)
addition_9 = Addition(A=Slider(27.5, range=0..50), B=multiplication_4)

# ---- group: Clicker Locator
pt_2 = ConstructPoint(XCoordinate=Slider(-30, range=-30..30), YCoordinate=Slider(0.36, range=-50..75), ZCoordinate=addition_7)
child_plane = ChildPlane(
    parent_plane=pl,
    offset_vector=pt_2,
    x_rotation=addition_8,
    y_rotation=Slider(0.276, range=-1.57..1.57),
    z_rotation=Slider(0, range=-1.57..1.57))

# ----
number_slider_11 = Slider(0, range=-1.57..1.57)
number_slider_12 = Slider(0, range=-1.57..1.57)
pt_3 = ConstructPoint(XCoordinate=Slider(0, range=-70..70), YCoordinate=Slider(4.909, range=-50..75), ZCoordinate=Slider(0, range=0..45))
multiplication_5 = Multiplication(A=remap_2.Clipped, B=Slider(12, range=0..20))
neg = Negative(Value=multiplication_5)
addition_10 = Addition(A=Slider(-45.721, range=-60..30), B=neg)

pt_4 = ConstructPoint(XCoordinate=addition_10, YCoordinate=Slider(-32.503, range=-80..75), ZCoordinate=Slider(9.818, range=0..45))
child_plane_2 = ChildPlane(
    parent_plane=pl,
    offset_vector=pt_4,
    x_rotation=Slider(0, range=-1.57..1.57),
    y_rotation=Slider(0, range=-1.57..1.57),
    z_rotation=Slider(0, range=-1.57..1.57))

devec = DeconstructVector(Vector=pt_4)  # -> XComponent, YComponent, ZComponent
pt_5 = ConstructPoint(XCoordinate=devec.XComponent, YCoordinate=addition_9, ZCoordinate=Slider(3, range=0..45))
child_plane_3 = ChildPlane(
    parent_plane=pl,
    offset_vector=pt_5,
    x_rotation=Slider(0, range=-1.57..1.57),
    y_rotation=number_slider_11,
    z_rotation=number_slider_12)
child_plane_4 = ChildPlane(
    parent_plane=child_plane_3,
    offset_vector=pt_3,
    x_rotation=Slider(-1.57, range=-1.57..1.57),
    y_rotation=number_slider_11,
    z_rotation=number_slider_12)
multiplication_6 = Multiplication(A=remap_2.Clipped, B=Slider(9, range=0..10))
addition_11 = Addition(A=Slider(55.7, range=-70..70), B=multiplication_6)
subtraction = Subtraction(A=addition_11, B=Slider(3.67, range=0..10))
number_slider_13 = Slider(1, range=0..1)
number_slider_14 = Slider(0, range=0..1)
xy = XYPlane(Origin=Point(0, 0, 0))
xy_2 = XYPlane(Origin=Point(0, 0, 0))

# ----
# IMPORT BASE PCB FIXTURE AND ALIGN
panel_8 = Panel("C:\Users\Thomas\OneDrive\Documents\MIDP\Inventor\STEP_Exports\Sensor_Base.stp")
panel_9 = Panel("C:\Users\khong\OneDrive\Documents\MIDP\Inventor\STEP_Exports\Sensor_Base.stp")
_3dm = Import3DM(File=panel_8, Layer="*", Name="*")
_3dm_2 = Import3DM(File=panel_9, Layer="*", Name="*")
merge_4 = Merge(Data1=_3dm_2, Data2=_3dm)
yz = YZPlane(Origin=Point(0, 0, 0))
rotate = Rotate(Geometry=merge_4, Angle=Slider(1.57, range=-1.57..1.57), Plane=yz)  # -> Geometry, Transform
vec = VectorXYZ(XComponent=Slider(-4.88, range=-10..10), YComponent=Slider(-5.48, range=-60..60), ZComponent=Slider(0, range=-10..10))  # -> Vector, Length
move = Move(Geometry=rotate.Geometry, Motion=vec.Vector)  # -> Geometry, Transform
item_9 = ListItem(List=move.Geometry, Index=0, Wrap=True)  # -> Item, Item1, Item2
debrep = DeconstructBrep(Brep=item_9.Item1)  # -> Faces, Edges, Vertices

# ----
# IMPORT PCB CLICKER AND ALIGN
panel_10 = Panel("C:\Users\Thomas\OneDrive\Documents\MIDP\Inventor\STEP_Exports\ClickerPCB_Attachment.stp")
panel_11 = Panel("C:\Users\khong\OneDrive\Documents\MIDP\Inventor\STEP_Exports\ClickerPCB_Attachment.stp")
_3dm_3 = Import3DM(File=panel_10, Layer="*", Name="*")
_3dm_4 = Import3DM(File=panel_11, Layer="*", Name="*")
merge_5 = Merge(Data1=_3dm_4, Data2=_3dm_3)
yz_2 = YZPlane(Origin=Point(0, 0, 0))
rotate_2 = Rotate(Geometry=merge_5, Angle=Slider(0, range=-1.57..1.57), Plane=yz_2)  # -> Geometry, Transform
xy_3 = XYPlane(Origin=Point(0, 0, 0))
rotate_3 = Rotate(Geometry=rotate_2.Geometry, Angle=Slider(3.141, range=-1.57..3.141), Plane=xy_3)  # -> Geometry, Transform
xz = XZPlane(Origin=Point(0, 0, 0))
rotate_4 = Rotate(Geometry=rotate_3.Geometry, Angle=Slider(0, range=-1.57..0), Plane=xz)  # -> Geometry, Transform

debrep_2 = DeconstructBrep(Brep=item_9.Item)  # -> Faces, Edges, Vertices
evalsrf = EvaluateSurface(Surface=reparameterize(debrep.Faces), Point=Point(0.5, 0.5, 0))  # -> Point, Normal, UDirection, VDirection, Frame
points = PointList(Points=evalsrf.Point)
number_slider_15 = Slider(-5.8, range=-70..70)
number_slider_16 = Slider(-37.4, range=-171..170)

# ---- group: RMB Control
pt_6 = ConstructPoint(
    XCoordinate=Slider(8.421, range=-30..30),
    YCoordinate=Slider(-48.714, range=-80..75),
    ZCoordinate=Slider(13.077, range=0..45))
devec_2 = DeconstructVector(Vector=pt_6)  # -> XComponent, YComponent, ZComponent
vec_2 = VectorXYZ(XComponent=devec_2.XComponent, YComponent=devec_2.YComponent, ZComponent=0)  # -> Vector, Length

# ----
multiplication_7 = Multiplication(A=vec_2.Vector, B=multiplication)
addition_12 = Addition(A=pt_6, B=multiplication_7)

# ---- group: RMB Control (continued)
child_plane_5 = ChildPlane(
    parent_plane=pl,
    offset_vector=addition_12,
    x_rotation=Slider(0.671, range=-1.57..1.57),
    y_rotation=Slider(0.545, range=-1.57..1.57),
    z_rotation=Slider(0.215, range=-1.57..1.57))

# ---- group: LMB Control
pt_7 = ConstructPoint(XCoordinate=Slider(0, range=-30..30), YCoordinate=Slider(76, range=-50..90), ZCoordinate=Slider(-6.759, range=-40..45))

# ----
multiplication_8 = Multiplication(A=pt_7, B=remap_4.Clipped)
addition_13 = Addition(A=pt_7, B=multiplication_8)

# ---- group: LMB Control (continued)
child_plane_6 = ChildPlane(
    parent_plane=child_plane,
    offset_vector=addition_13,
    x_rotation=Slider(-0.217, range=-1.57..1.57),
    y_rotation=Slider(-0.05, range=-1.57..1.57),
    z_rotation=Slider(0, range=-1.57..1.57))

# ----
devec_3 = DeconstructVector(Vector=addition_13)  # -> XComponent, YComponent, ZComponent
addition_14 = Addition(A=devec_3.YComponent, B=Slider(-7.04, range=-10..10))

# ----
# BUTTONS
number_slider_17 = Slider(-1, range=-1..1)
vec_3 = VectorXYZ(XComponent=number_slider_17, YComponent=Slider(0, range=-1..1), ZComponent=Slider(1, range=-1..1))  # -> Vector, Length
vec_4 = VectorXYZ(XComponent=Slider(1, range=-1..1), YComponent=Slider(0, range=-1..1), ZComponent=Slider(0.368, range=-1..1))  # -> Vector, Length
pt_8 = ConstructPoint(XCoordinate=Slider(0, range=-70..70), YCoordinate=Slider(-2.884, range=-50..75), ZCoordinate=Slider(0, range=-20..45))
pt_9 = ConstructPoint(XCoordinate=addition_11, YCoordinate=Slider(0, range=-50..75), ZCoordinate=Slider(-5.696, range=-20..45))
vec_5 = VectorXYZ(XComponent=Slider(-1, range=-1..1), YComponent=Slider(0, range=-1..1), ZComponent=Slider(0.368, range=-1..1))  # -> Vector, Length
vec_6 = VectorXYZ(XComponent=Slider(1, range=-1..1), YComponent=Slider(0, range=-1..1), ZComponent=Slider(0.368, range=-1..1))  # -> Vector, Length
pt_10 = ConstructPoint(XCoordinate=Slider(5.756, range=-70..70), YCoordinate=Slider(0, range=-50..75), ZCoordinate=Slider(0, range=0..45))
pt_11 = ConstructPoint(XCoordinate=subtraction, YCoordinate=Slider(2, range=-50..75), ZCoordinate=Slider(0, range=0..45))
vec2pt = Vector2Pt(PointA=pt_10, PointB=pt_11, Unitize=False)  # -> Vector, Length
vec2pt_2 = Vector2Pt(PointA=pt_8, PointB=pt_9, Unitize=False)  # -> Vector, Length
multiplication_9 = Multiplication(A=vec2pt.Length, B=Slider(0.25, range=0..1))
multiplication_10 = Multiplication(A=vec2pt_2.Length, B=Slider(0.15, range=0..1))
multiplication_11 = Multiplication(A=vec2pt_2.Length, B=Slider(0.2, range=0..1))
cluster = Cluster(
    reference_plane=child_plane_6,
    point_1=pt_10,
    control_direction_1=vec_6.Vector,
    point_1_tangency_condition=Slider(-1, range=-1..1),
    point_1_tangency_weight=multiplication_9,
    point_2=pt_11,
    control_direction_2=vec_5.Vector,
    point_2_tangency_condition=Slider(-1, range=-1..1),
    point_2_tangency_weight=multiplication_9)  # -> curve_result, point_1_4, point_1_tangent_vector, point_2_2, point_2_tangent_vector
cluster_2 = Cluster(
    reference_plane=child_plane,
    point_1=pt_8,
    control_direction_1=vec_4.Vector,
    point_1_tangency_condition=Slider(-1, range=-1..1),
    point_1_tangency_weight=multiplication_10,
    point_2=pt_9,
    control_direction_2=vec_3.Vector,
    point_2_tangency_condition=Slider(-1, range=-1..1),
    point_2_tangency_weight=multiplication_11)  # -> curve_result, point_1_4, point_1_tangent_vector, point_2_2, point_2_tangent_vector
eval = EvaluateCurve(Curve=cluster_2.curve_result, Parameter=Slider(0, range=0..1))  # -> Point, Tangent, Angle
eval_2 = EvaluateCurve(Curve=cluster_2.curve_result, Parameter=Slider(1, range=0..1))  # -> Point, Tangent, Angle
eval_3 = EvaluateCurve(Curve=cluster.curve_result, Parameter=Slider(0, range=0..1))  # -> Point, Tangent, Angle
eval_4 = EvaluateCurve(Curve=cluster.curve_result, Parameter=Slider(1, range=0..1))  # -> Point, Tangent, Angle
vec_7 = VectorXYZ(XComponent=Slider(0.405, range=-1..1), YComponent=Slider(-1, range=-1..1), ZComponent=Slider(1, range=-1..1))  # -> Vector, Length
vec2pt_3 = Vector2Pt(PointA=eval_4.Point, PointB=eval_2.Point, Unitize=False)  # -> Vector, Length
vec_8 = VectorXYZ(XComponent=Slider(0, range=-1..1), YComponent=Slider(1, range=-1..1), ZComponent=Slider(-0.012, range=-1..1))  # -> Vector, Length
vec_9 = VectorXYZ(XComponent=Slider(0, range=-1..1), YComponent=Slider(0, range=-1..1), ZComponent=Slider(0, range=-1..1))  # -> Vector, Length
vec_10 = VectorXYZ(XComponent=Slider(-0.016, range=-1..1), YComponent=Slider(1, range=-1..1), ZComponent=Slider(0.302, range=-1..1))  # -> Vector, Length
vec2pt_4 = Vector2Pt(PointA=eval_3.Point, PointB=eval.Point, Unitize=False)  # -> Vector, Length
multiplication_12 = Multiplication(A=vec2pt_3.Length, B=Slider(0.125, range=0..1))
multiplication_13 = Multiplication(A=vec2pt_4.Length, B=Slider(0.02, range=0..1))
multiplication_14 = Multiplication(A=vec2pt_4.Length, B=Slider(0.487, range=0..1))
multiplication_15 = Multiplication(A=vec2pt_3.Length, B=Slider(0.333, range=0..1))
xy_4 = XYPlane(Origin=Point(0, 0, 0))
xy_5 = XYPlane(Origin=Point(0, 0, 0))
cluster_3 = Cluster(
    reference_plane=xy_4,
    point_1=eval_3.Point,
    control_direction_1=vec_9.Vector,
    point_1_tangency_condition=Slider(-1, range=-1..1),
    point_1_tangency_weight=multiplication_13,
    point_2=eval.Point,
    control_direction_2=vec_8.Vector,
    point_2_tangency_condition=Slider(-1, range=-1..1),
    point_2_tangency_weight=multiplication_14)  # -> curve_result, point_1_4, point_1_tangent_vector, point_2_2, point_2_tangent_vector
cluster_4 = Cluster(
    reference_plane=xy_5,
    point_1=eval_4.Point,
    control_direction_1=vec_7.Vector,
    point_1_tangency_condition=Slider(-1, range=-1..1),
    point_1_tangency_weight=multiplication_12,
    point_2=eval_2.Point,
    control_direction_2=vec_10.Vector,
    point_2_tangency_condition=Slider(-1, range=-1..1),
    point_2_tangency_weight=multiplication_15)  # -> curve_result, point_1_4, point_1_tangent_vector, point_2_2, point_2_tangent_vector
eval_5 = EvaluateCurve(Curve=cluster_3.curve_result, Parameter=Slider(1, range=0..1))  # -> Point, Tangent, Angle
eval_6 = EvaluateCurve(Curve=cluster_4.curve_result, Parameter=Slider(1, range=0..1))  # -> Point, Tangent, Angle
edgesrf = EdgeSurface(CurveA=cluster.curve_result, CurveB=cluster_4.curve_result, CurveC=cluster_2.curve_result, CurveD=cluster_3.curve_result)

devec_4 = DeconstructVector(Vector=eval_2.Point)  # -> XComponent, YComponent, ZComponent
pdecon = Deconstruct(Point=eval_4.Point)  # -> XComponent, YComponent, ZComponent
addition_15 = Addition(A=devec_4.XComponent, B=Slider(5.42, range=0..20))
addition_16 = Addition(A=pdecon.XComponent, B=Slider(5.89, range=0..15))

pt_12 = ConstructPoint(XCoordinate=addition_15, YCoordinate=Slider(-2.808, range=-80..75), ZCoordinate=Slider(3, range=0..45))
child_plane_7 = ChildPlane(
    parent_plane=pl,
    offset_vector=pt_12,
    x_rotation=Slider(0, range=-1.57..1.57),
    y_rotation=Slider(0, range=-1.57..1.57),
    z_rotation=Slider(0, range=-1.57..1.57))

pt_13 = ConstructPoint(XCoordinate=addition_16, YCoordinate=addition_14, ZCoordinate=Slider(3, range=0..45))
child_plane_8 = ChildPlane(
    parent_plane=pl,
    offset_vector=pt_13,
    x_rotation=Slider(0, range=-1.57..1.57),
    y_rotation=Slider(0, range=-1.57..1.57),
    z_rotation=Slider(0, range=-1.57..1.57))
pcx = CurvePlane(Curve=cluster_3.curve_result, Plane=child_plane_4)  # -> flatten(Points), ParamsC, ParamsP
shatter = Shatter(Curve=reparameterize(cluster_3.curve_result), Parameters=pcx.ParamsC)

# ----
# PALM REST
number_slider_18 = Slider(-1, range=-1..1)
number_slider_19 = Slider(5.782, range=0..50)
vec_11 = VectorXYZ(XComponent=Slider(-1, range=-1..1), YComponent=Slider(0, range=-1..1), ZComponent=Slider(0.368, range=-1..1))  # -> Vector, Length
pt_14 = ConstructPoint(XCoordinate=Slider(-10, range=-70..70), YCoordinate=Slider(0, range=-50..75), ZCoordinate=Slider(0, range=0..45))
pt_15 = ConstructPoint(XCoordinate=Slider(10, range=-70..70), YCoordinate=Slider(0, range=-50..75), ZCoordinate=Slider(0, range=0..45))
vec_12 = VectorXYZ(XComponent=Slider(1, range=-1..1), YComponent=Slider(0, range=-1..1), ZComponent=Slider(0.368, range=-1..1))  # -> Vector, Length
cluster_5 = Cluster(
    reference_plane=child_plane_5,
    point_1=pt_14,
    control_direction_1=vec_12.Vector,
    point_1_tangency_condition=Slider(-1, range=-1..1),
    point_1_tangency_weight=number_slider_19,
    point_2=pt_15,
    control_direction_2=vec_11.Vector,
    point_2_tangency_condition=number_slider_18,
    point_2_tangency_weight=number_slider_19)  # -> curve_result, point_1_4, point_1_tangent_vector, point_2_2, point_2_tangent_vector
eval_7 = EvaluateCurve(Curve=cluster_5.curve_result, Parameter=Slider(0, range=0..1))  # -> Point, Tangent, Angle
eval_8 = EvaluateCurve(Curve=cluster_5.curve_result, Parameter=Slider(1, range=0..1))  # -> Point, Tangent, Angle
vec_13 = VectorXYZ(XComponent=Slider(-0.459, range=-1..1), YComponent=Slider(1, range=-1..1), ZComponent=Slider(1, range=-1..1))  # -> Vector, Length
vec2pt_5 = Vector2Pt(PointA=eval_6.Point, PointB=eval_8.Point, Unitize=False)  # -> Vector, Length
vec_14 = VectorXYZ(XComponent=Slider(0, range=-1..1), YComponent=Slider(1, range=-1..1), ZComponent=Slider(0.762, range=-1..1))  # -> Vector, Length
vec_15 = VectorXYZ(XComponent=Slider(0.18, range=-1..1), YComponent=Slider(0, range=-1..1), ZComponent=Slider(0, range=-1..1))  # -> Vector, Length
vec2pt_6 = Vector2Pt(PointA=eval_5.Point, PointB=eval_7.Point, Unitize=False)  # -> Vector, Length
multiplication_16 = Multiplication(A=vec2pt_5.Length, B=Slider(0.58, range=0..1))
multiplication_17 = Multiplication(A=vec2pt_5.Length, B=Slider(0.27, range=0..1))
multiplication_18 = Multiplication(A=vec2pt_6.Length, B=Slider(0.15, range=0..1))
xy_6 = XYPlane(Origin=Point(0, 0, 0))
multiplication_19 = Multiplication(A=vec2pt_6.Length, B=Slider(0.34, range=0..1))
xy_7 = XYPlane(Origin=Point(0, 0, 0))
cluster_6 = Cluster(
    reference_plane=xy_6,
    point_1=eval_5.Point,
    control_direction_1=eval_5.Tangent,
    point_1_tangency_condition=Slider(-1, range=-1..1),
    point_1_tangency_weight=multiplication_19,
    point_2=eval_7.Point,
    control_direction_2=vec_14.Vector,
    point_2_tangency_condition=Slider(-1, range=-1..1),
    point_2_tangency_weight=multiplication_18)  # -> curve_result, point_1_4, point_1_tangent_vector, point_2_2, point_2_tangent_vector
cluster_7 = Cluster(
    reference_plane=xy_7,
    point_1=eval_6.Point,
    control_direction_1=eval_6.Tangent,
    point_1_tangency_condition=Slider(-1, range=-1..1),
    point_1_tangency_weight=multiplication_16,
    point_2=eval_8.Point,
    control_direction_2=vec_13.Vector,
    point_2_tangency_condition=Slider(-1, range=-1..1),
    point_2_tangency_weight=multiplication_17)  # -> curve_result, point_1_4, point_1_tangent_vector, point_2_2, point_2_tangent_vector
edgesrf_2 = EdgeSurface(
    CurveA=cluster_2.curve_result,
    CurveB=cluster_7.curve_result,
    CurveC=cluster_5.curve_result,
    CurveD=cluster_6.curve_result)

# ----
# LEFT WING BLEND
number_slider_20 = Slider(1, range=-1..1)
plcoord = PlaneCoordinates(Point=eval.Point, System=child_plane_2)  # -> XCoordinate, YCoordinate, ZCoordinate
pt_16 = ConstructPoint(XCoordinate=plcoord.XCoordinate, YCoordinate=plcoord.YCoordinate, ZCoordinate=plcoord.ZCoordinate)
vec_16 = VectorXYZ(XComponent=Slider(-1, range=-1..1), YComponent=Slider(0, range=-1..1), ZComponent=Slider(0.368, range=-1..1))  # -> Vector, Length
pt_17 = ConstructPoint(XCoordinate=Slider(0, range=-70..70), YCoordinate=Slider(0, range=-50..75), ZCoordinate=Slider(0, range=0..45))
vec_17 = VectorXYZ(XComponent=Slider(1, range=-1..1), YComponent=Slider(0, range=-1..1), ZComponent=Slider(0.468, range=-1..1))  # -> Vector, Length
vec2pt_7 = Vector2Pt(PointA=pt_17, PointB=pt_16, Unitize=False)  # -> Vector, Length
multiplication_20 = Multiplication(A=vec2pt_7.Length, B=Slider(0.47, range=0..1))
multiplication_21 = Multiplication(A=vec2pt_7.Length, B=Slider(0.16, range=0..1))
cluster_8 = Cluster(
    reference_plane=child_plane_2,
    point_1=pt_17,
    control_direction_1=vec_17.Vector,
    point_1_tangency_condition=Slider(-1, range=-1..1),
    point_1_tangency_weight=multiplication_20,
    point_2=pt_16,
    control_direction_2=eval.Tangent,
    point_2_tangency_condition=number_slider_20,
    point_2_tangency_weight=multiplication_21)  # -> curve_result, point_1_4, point_1_tangent_vector, point_2_2, point_2_tangent_vector
eval_9 = EvaluateCurve(Curve=cluster_8.curve_result, Parameter=Slider(0, range=0..1))  # -> Point, Tangent, Angle
vec_18 = VectorXYZ(XComponent=Slider(0.595, range=-1..1), YComponent=Slider(-1, range=-1..1), ZComponent=Slider(0.172, range=-1..1))  # -> Vector, Length
vec2pt_8 = Vector2Pt(PointA=eval_9.Point, PointB=eval_7.Point, Unitize=False)  # -> Vector, Length
multiplication_22 = Multiplication(A=vec2pt_8.Length, B=Slider(0.35, range=0..1))
multiplication_23 = Multiplication(A=vec2pt_8.Length, B=Slider(0.3, range=0..1))
xy_8 = XYPlane(Origin=Point(0, 0, 0))
cluster_9 = Cluster(
    reference_plane=xy_8,
    point_1=eval_9.Point,
    control_direction_1=vec_18.Vector,
    point_1_tangency_condition=Slider(-1, range=-1..1),
    point_1_tangency_weight=multiplication_22,
    point_2=eval_7.Point,
    control_direction_2=eval_7.Tangent,
    point_2_tangency_condition=Slider(1, range=-1..1),
    point_2_tangency_weight=multiplication_23)  # -> curve_result, point_1_4, point_1_tangent_vector, point_2_2, point_2_tangent_vector
edgesrf_3 = EdgeSurface(CurveA=cluster_8.curve_result, CurveB=cluster_9.curve_result, CurveC=cluster_6.curve_result)

# ----
# RIGHT WING BLEND
number_slider_21 = Slider(-1, range=-1..1)
plcoord_2 = PlaneCoordinates(Point=eval_2.Point, System=child_plane_7)  # -> XCoordinate, YCoordinate, ZCoordinate
pt_18 = ConstructPoint(XCoordinate=plcoord_2.XCoordinate, YCoordinate=plcoord_2.YCoordinate, ZCoordinate=plcoord_2.ZCoordinate)
pt_19 = ConstructPoint(XCoordinate=Slider(0, range=-70..70), YCoordinate=Slider(0, range=-50..75), ZCoordinate=Slider(0, range=0..45))
vec_19 = VectorXYZ(XComponent=Slider(-1, range=-1..1), YComponent=Slider(0, range=-1..1), ZComponent=Slider(0.52, range=-1..1))  # -> Vector, Length
vec2pt_9 = Vector2Pt(PointA=pt_18, PointB=pt_19, Unitize=False)  # -> Vector, Length
multiplication_24 = Multiplication(A=vec2pt_9.Length, B=Slider(0.28, range=0..1))
multiplication_25 = Multiplication(A=vec2pt_9.Length, B=Slider(0.46, range=0..1))
cluster_10 = Cluster(
    reference_plane=child_plane_7,
    point_1=pt_18,
    control_direction_1=eval_2.Tangent,
    point_1_tangency_condition=Slider(-1, range=-1..1),
    point_1_tangency_weight=multiplication_24,
    point_2=pt_19,
    control_direction_2=vec_19.Vector,
    point_2_tangency_condition=number_slider_21,
    point_2_tangency_weight=multiplication_25)  # -> curve_result, point_1_4, point_1_tangent_vector, point_2_2, point_2_tangent_vector
eval_10 = EvaluateCurve(Curve=cluster_10.curve_result, Parameter=Slider(1, range=0..1))  # -> Point, Tangent, Angle
vec_20 = VectorXYZ(XComponent=Slider(-0.459, range=-1..1), YComponent=Slider(1, range=-1..1), ZComponent=Slider(1, range=-1..1))  # -> Vector, Length
vec_21 = VectorXYZ(XComponent=Slider(0.061, range=-1..1), YComponent=Slider(-1, range=-1..1), ZComponent=Slider(0, range=-1..1))  # -> Vector, Length
vec2pt_10 = Vector2Pt(PointA=eval_10.Point, PointB=eval_8.Point, Unitize=False)  # -> Vector, Length
multiplication_26 = Multiplication(A=vec2pt_10.Length, B=Slider(0.41, range=0..1))
multiplication_27 = Multiplication(A=vec2pt_10.Length, B=Slider(0.42, range=0..1))
xy_9 = XYPlane(Origin=Point(0, 0, 0))
cluster_11 = Cluster(
    reference_plane=xy_9,
    point_1=eval_10.Point,
    control_direction_1=vec_21.Vector,
    point_1_tangency_condition=Slider(-1, range=-1..1),
    point_1_tangency_weight=multiplication_26,
    point_2=eval_8.Point,
    control_direction_2=eval_8.Tangent,
    point_2_tangency_condition=Slider(-1, range=-1..1),
    point_2_tangency_weight=multiplication_27)  # -> curve_result, point_1_4, point_1_tangent_vector, point_2_2, point_2_tangent_vector
edgesrf_4 = EdgeSurface(CurveA=cluster_10.curve_result, CurveB=cluster_11.curve_result, CurveC=cluster_7.curve_result)

# ----
# RIGHT WING
number_slider_22 = Slider(-1, range=-1..1)
plcoord_3 = PlaneCoordinates(Point=eval_4.Point, System=child_plane_8)  # -> XCoordinate, YCoordinate, ZCoordinate
pt_20 = ConstructPoint(XCoordinate=plcoord_3.XCoordinate, YCoordinate=plcoord_3.YCoordinate, ZCoordinate=plcoord_3.ZCoordinate)
pt_21 = ConstructPoint(XCoordinate=Slider(1.75, range=-70..70), YCoordinate=Slider(0, range=-50..75), ZCoordinate=Slider(0, range=0..45))
vec_22 = VectorXYZ(XComponent=Slider(-1, range=-1..1), YComponent=Slider(0, range=-1..1), ZComponent=Slider(0.08, range=-1..1))  # -> Vector, Length
vec_23 = VectorXYZ(XComponent=Slider(0, range=-1..1), YComponent=Slider(0, range=-1..1), ZComponent=Slider(-0.467, range=-1..1))  # -> Vector, Length
vec2pt_11 = Vector2Pt(PointA=pt_20, PointB=pt_21, Unitize=False)  # -> Vector, Length
multiplication_28 = Multiplication(A=vec2pt_11.Length, B=Slider(0.6, range=0..1))
multiplication_29 = Multiplication(A=vec2pt_11.Length, B=Slider(0.81, range=0..1))
cluster_12 = Cluster(
    reference_plane=child_plane_8,
    point_1=pt_20,
    control_direction_1=vec_23.Vector,
    point_1_tangency_condition=Slider(-1, range=-1..1),
    point_1_tangency_weight=multiplication_28,
    point_2=pt_21,
    control_direction_2=vec_22.Vector,
    point_2_tangency_condition=number_slider_22,
    point_2_tangency_weight=multiplication_29)  # -> curve_result, point_1_4, point_1_tangent_vector, point_2_2, point_2_tangent_vector
eval_11 = EvaluateCurve(Curve=cluster_12.curve_result, Parameter=Slider(1, range=0..1))  # -> Point, Tangent, Angle
vec_24 = VectorXYZ(XComponent=Slider(0.186, range=-1..1), YComponent=Slider(-1, range=-1..1), ZComponent=Slider(0, range=-1..1))  # -> Vector, Length
vec2pt_12 = Vector2Pt(PointA=eval_11.Point, PointB=eval_10.Point, Unitize=False)  # -> Vector, Length
multiplication_30 = Multiplication(A=vec2pt_12.Length, B=Slider(0.51, range=0..1))
multiplication_31 = Multiplication(A=vec2pt_12.Length, B=Slider(0.24, range=0..1))
xy_10 = XYPlane(Origin=Point(0, 0, 0))
cluster_13 = Cluster(
    reference_plane=xy_10,
    point_1=eval_11.Point,
    control_direction_1=vec_24.Vector,
    point_1_tangency_condition=Slider(-1, range=-1..1),
    point_1_tangency_weight=multiplication_31,
    point_2=eval_10.Point,
    control_direction_2=cluster_11.point_1_tangent_vector,
    point_2_tangency_condition=Slider(1, range=-1..1),
    point_2_tangency_weight=multiplication_30)  # -> curve_result, point_1_4, point_1_tangent_vector, point_2_2, point_2_tangent_vector
edgesrf_5 = EdgeSurface(
    CurveA=cluster_12.curve_result,
    CurveB=cluster_13.curve_result,
    CurveC=cluster_10.curve_result,
    CurveD=cluster_4.curve_result)

item_10 = ListItem(List=shatter, Index=Slider(1, range=0..1), Wrap=True)

# ----
# LEFT WING
number_slider_23 = Slider(-1, range=-1..1)
plcoord_4 = PlaneCoordinates(Point=pcx.Points, System=child_plane_3)  # -> XCoordinate, YCoordinate, ZCoordinate
pt_22 = ConstructPoint(XCoordinate=plcoord_4.XCoordinate, YCoordinate=plcoord_4.YCoordinate, ZCoordinate=plcoord_4.ZCoordinate)
vec_25 = VectorXYZ(XComponent=Slider(-1, range=-1..1), YComponent=Slider(0, range=-1..1), ZComponent=Slider(-0.15, range=-1..1))  # -> Vector, Length
pt_23 = ConstructPoint(XCoordinate=Slider(0, range=-70..70), YCoordinate=Slider(0, range=-50..75), ZCoordinate=Slider(0, range=0..45))
vec_26 = VectorXYZ(XComponent=Slider(1, range=-1..1), YComponent=Slider(0, range=-1..1), ZComponent=Slider(0, range=-1..1))  # -> Vector, Length
vec2pt_13 = Vector2Pt(PointA=pt_23, PointB=pt_22, Unitize=False)  # -> Vector, Length
multiplication_32 = Multiplication(A=vec2pt_13.Length, B=Slider(0.333, range=0..1))
multiplication_33 = Multiplication(A=vec2pt_13.Length, B=Slider(0.716, range=0..1))
cluster_14 = Cluster(
    reference_plane=child_plane_3,
    point_1=pt_23,
    control_direction_1=vec_26.Vector,
    point_1_tangency_condition=Slider(-1, range=-1..1),
    point_1_tangency_weight=multiplication_33,
    point_2=pt_22,
    control_direction_2=vec_25.Vector,
    point_2_tangency_condition=number_slider_23,
    point_2_tangency_weight=multiplication_32)  # -> curve_result, point_1_4, point_1_tangent_vector, point_2_2, point_2_tangent_vector
eval_12 = EvaluateCurve(Curve=cluster_14.curve_result, Parameter=Slider(0, range=0..1))  # -> Point, Tangent, Angle
vec_27 = VectorXYZ(XComponent=Slider(-0.32, range=-1..1), YComponent=Slider(-1, range=-1..1), ZComponent=Slider(0, range=-1..1))  # -> Vector, Length
vec2pt_14 = Vector2Pt(PointA=eval_12.Point, PointB=eval_9.Point, Unitize=False)  # -> Vector, Length
multiplication_34 = Multiplication(A=vec2pt_14.Length, B=Slider(0.433, range=0..1))
multiplication_35 = Multiplication(A=vec2pt_14.Length, B=Slider(0.327, range=0..1))
xy_11 = XYPlane(Origin=Point(0, 0, 0))
cluster_15 = Cluster(
    reference_plane=xy_11,
    point_1=eval_12.Point,
    control_direction_1=vec_27.Vector,
    point_1_tangency_condition=Slider(-1, range=-1..1),
    point_1_tangency_weight=multiplication_35,
    point_2=eval_9.Point,
    control_direction_2=cluster_9.point_1_tangent_vector,
    point_2_tangency_condition=Slider(1, range=-1..1),
    point_2_tangency_weight=multiplication_34)  # -> curve_result, point_1_4, point_1_tangent_vector, point_2_2, point_2_tangent_vector
edgesrf_6 = EdgeSurface(CurveA=cluster_14.curve_result, CurveB=item_10, CurveC=cluster_8.curve_result, CurveD=cluster_15.curve_result)

item_11 = ListItem(List=shatter, Index=Slider(0, range=0..1), Wrap=True)

md_slider = MDSlider(
    SliderMode=0,
    slider_value=Point(0.4127405678, 0.6267506669, 0.5),
    x_domain=Domain(0, 1),
    y_domain=Domain(0, 1),
    z_domain=Domain(0, 1))
md_slider_2 = MDSlider(
    SliderMode=0,
    slider_value=Point(0.8619950457, 0.1118640434, 0.5),
    x_domain=Domain(0, 1),
    y_domain=Domain(0, 1),
    z_domain=Domain(0, 1))
md_slider_3 = MDSlider(
    SliderMode=0,
    slider_value=Point(0.5202815358, 0.07545731707, 0.5),
    x_domain=Domain(0, 1),
    y_domain=Domain(0, 1),
    z_domain=Domain(0, 1))
md_slider_4 = MDSlider(
    SliderMode=0,
    slider_value=Point(0.7289443598, 0.8331983613, 0.5),
    x_domain=Domain(0, 1),
    y_domain=Domain(0, 1),
    z_domain=Domain(0, 1))
merge_6 = Merge(Data1=md_slider, Data2=md_slider_3, Data3=md_slider_2, Data4=md_slider_4)
merge_7 = Merge(Data1=md_slider_4, Data2=md_slider)
crvsrf = CurveOnSurface(Surface=reparameterize(edgesrf_6), UVCoordinates=merge_7, Closed=False)  # -> Curve, Length, Domain
crvsrf_2 = CurveOnSurface(Surface=reparameterize(edgesrf_6), UVCoordinates=merge_6, Closed=False)  # -> Curve, Length, Domain
merge_8 = Merge(Data1=crvsrf_2.Curve, Data2=crvsrf.Curve)
srfsplit = SurfaceSplit(Surface=edgesrf_6, Curves=merge_8)
item_12 = ListItem(List=srfsplit, Index=0, Wrap=True)

# ----
# SKIRT
number_slider_24 = Slider(-3, range=-5..5)
merge_9 = Merge(
    Data1=cluster_15.curve_result,
    Data2=cluster_9.curve_result,
    Data3=cluster_5.curve_result,
    Data4=cluster_11.curve_result,
    Data5=cluster_13.curve_result)
join = JoinCurves(Curves=merge_9, Preserve=False)
Z_2 = UnitZ(Factor=number_slider_24)
move_2 = Move(Geometry=join, Motion=Z_2)  # -> Geometry, Transform
xy_12 = XYPlane(Origin=Point(0, 0, 0))
merge_10 = Merge(Data1=eval_9.Point, Data2=eval_7.Point, Data3=eval_8.Point, Data4=eval_10.Point)
offset = OffsetCurve(Curve=move_2.Geometry, Distance=Slider(-5, range=-5..5), Plane=xy_12, Corners=1)
merge_11 = Merge(Data1=move_2.Geometry, Data2=offset)  # -> flatten(Result)
crv_cp = CurveClosestPoint(Point=merge_10, Curve=offset)  # -> Point, Parameter, Distance
loft = Loft(
    Curves=[move_2.Geometry, join],
    Options={Adjust=False, Closed=False, LoftEnds=0, LoftSimp=0, LoftType=0, Rebuild=10, Refit=0.01})
loft_2 = Loft(Curves=merge_11, Options={Adjust=False, Closed=False, LoftEnds=0, LoftSimp=0, LoftType=0, Rebuild=10, Refit=0.01})

# ----
# BUTTON EDGE OFFSETS
number_slider_25 = Slider(0, range=-30..30)
pt_24 = ConstructPoint(XCoordinate=number_slider_25, YCoordinate=Slider(0, range=-50..75), ZCoordinate=Slider(0, range=0..65))
pt_25 = ConstructPoint(XCoordinate=Slider(0, range=-30..30), YCoordinate=Slider(0, range=-50..75), ZCoordinate=Slider(0, range=0..65))
child_plane_9 = ChildPlane(
    parent_plane=child_plane,
    offset_vector=pt_24,
    x_rotation=Slider(1.57, range=-1.57..1.57),
    y_rotation=Slider(0, range=-1.57..1.57),
    z_rotation=Slider(0, range=-1.57..1.57))
child_plane_10 = ChildPlane(
    parent_plane=child_plane_6,
    offset_vector=pt_25,
    x_rotation=Slider(1.57, range=-1.57..1.57),
    y_rotation=Slider(0, range=-1.57..1.57),
    z_rotation=Slider(0, range=-1.57..1.57))
offset_2 = OffsetCurve(Curve=cluster_2.curve_result, Distance=Slider(1.5, range=-5..5), Plane=child_plane_9, Corners=1)  # -> reparameterize(Curve)
offset_3 = OffsetCurve(Curve=cluster.curve_result, Distance=Slider(2, range=-5..5), Plane=child_plane_10, Corners=1)  # -> reparameterize(Curve)
offset_4 = OffsetCurve(Curve=cluster.curve_result, Distance=Slider(4.42, range=-5..5), Plane=child_plane_10, Corners=1)  # -> reparameterize(Curve)

debrep_3 = DeconstructBrep(Brep=edgesrf_6)  # -> Faces, Edges, Vertices
debrep_4 = DeconstructBrep(Brep=edgesrf_5)  # -> Faces, Edges, Vertices
offsets = OffsetOnSrf(Curve=debrep_3.Edges, Distance=Slider(5.24, range=0..20), Surface=edgesrf_6)  # -> flatten(Curve)
offsets_2 = OffsetOnSrf(Curve=debrep_4.Edges, Distance=Slider(5.24, range=0..20), Surface=edgesrf_5)  # -> flatten(Curve)
srfsplit_2 = SurfaceSplit(Surface=edgesrf_6, Curves=offsets)
srfsplit_3 = SurfaceSplit(Surface=edgesrf_5, Curves=offsets_2)

# ----
# OUTER SURFACE MERGE
merge_12 = Merge(Data1=edgesrf, Data2=edgesrf_2, Data3=edgesrf_3, Data4=edgesrf_4, Data5=edgesrf_5, Data6=edgesrf_6)  # -> flatten(Result)

item_13 = ListItem(List=srfsplit_2, Index=number_slider_13, Wrap=True)
item_14 = ListItem(List=srfsplit_3, Index=number_slider_14, Wrap=True)
debrep_5 = DeconstructBrep(Brep=item_13)  # -> Faces, Edges, Vertices
debrep_6 = DeconstructBrep(Brep=item_14)  # -> Faces, Edges, Vertices
join_2 = JoinCurves(Curves=debrep_5.Edges, Preserve=False)
join_3 = JoinCurves(Curves=debrep_6.Edges, Preserve=False)
topoly = CurveToPolyline(Curve=join_2, ToleranceDistance=0, ToleranceAngle=0)  # -> Polyline, Segments
topoly_2 = CurveToPolyline(Curve=join_3, ToleranceDistance=0, ToleranceAngle=0)  # -> Polyline, Segments
explode = Explode(Curve=topoly.Polyline, Recursive=True)  # -> Segments, Vertices
explode_2 = Explode(Curve=topoly_2.Polyline, Recursive=True)  # -> Segments, Vertices
item_15 = ListItem(List=explode.Segments, Index=0, Wrap=True)  # -> Item, Item1, Item2, Item3
fillet = Fillet(Curve=topoly.Polyline, Radius=Slider(10.6, range=0..50))
item_16 = ListItem(List=explode_2.Segments, Index=0, Wrap=True)  # -> Item, Item1, Item2, Item3
fillet_2 = Fillet(Curve=topoly_2.Polyline, Radius=Slider(10.6, range=0..50))
edgesrf_7 = EdgeSurface(CurveA=item_15.Item, CurveB=item_15.Item1, CurveC=item_15.Item2, CurveD=item_15.Item3)
edgesrf_8 = EdgeSurface(CurveA=item_16.Item, CurveB=item_16.Item1, CurveC=item_16.Item2, CurveD=item_16.Item3)
evalsrf_2 = EvaluateSurface(Surface=reparameterize(edgesrf_7), Point=Point(0.5, 0.5, 0))  # -> Point, Normal, UDirection, VDirection, Frame
evalsrf_3 = EvaluateSurface(Surface=reparameterize(edgesrf_8), Point=Point(0.5, 0.5, 0))  # -> Point, Normal, UDirection, VDirection, Frame
srfsplit_4 = SurfaceSplit(Surface=edgesrf_6, Curves=fillet)
srfsplit_5 = SurfaceSplit(Surface=edgesrf_5, Curves=fillet_2)
item_17 = ListItem(List=srfsplit_4, Index=number_slider_13, Wrap=True)
multiplication_36 = Multiplication(A=evalsrf_2.Normal, B=Slider(1.8, range=0..5))
item_18 = ListItem(List=srfsplit_5, Index=number_slider_14, Wrap=True)
multiplication_37 = Multiplication(A=evalsrf_3.Normal, B=Slider(1.8, range=0..5))
extr = Extrude(Base=item_13, Direction=multiplication_36)
extr_2 = Extrude(Base=item_14, Direction=multiplication_37)

# ----
# SKIRT INDIVIDUAL SELECT
shatter_2 = Shatter(Curve=offset, Parameters=crv_cp.Parameter)
item_19 = ListItem(List=crv_cp.Point, Index=Slider(0, range=0..3), Wrap=True)  # -> flatten(Item)
item_20 = ListItem(List=crv_cp.Point, Index=Slider(1, range=0..3), Wrap=True)  # -> flatten(Item)
item_21 = ListItem(List=crv_cp.Point, Index=Slider(2, range=0..3), Wrap=True)  # -> flatten(Item)
item_22 = ListItem(List=crv_cp.Point, Index=Slider(3, range=0..3), Wrap=True)  # -> flatten(Item)
item_23 = ListItem(List=shatter_2, Index=Slider(0, range=0..3), Wrap=True)
item_24 = ListItem(List=shatter_2, Index=Slider(1, range=0..3), Wrap=True)
item_25 = ListItem(List=shatter_2, Index=Slider(2, range=0..3), Wrap=True)
item_26 = ListItem(List=shatter_2, Index=Slider(3, range=0..3), Wrap=True)
item_27 = ListItem(List=shatter_2, Index=Slider(4, range=0..4), Wrap=True)

eval_13 = EvaluateCurve(Curve=offset_2, Parameter=Slider(0, range=0..1))  # -> Point, Tangent, Angle
eval_14 = EvaluateCurve(Curve=offset_2, Parameter=Slider(1, range=0..1))  # -> Point, Tangent, Angle
eval_15 = EvaluateCurve(Curve=reparameterize(offset), Parameter=Slider(1, range=0..1))  # -> flatten(Point), Tangent, Angle
eval_16 = EvaluateCurve(Curve=reparameterize(offset), Parameter=Slider(0, range=0..1))  # -> Point, Tangent, Angle

# ----
# INTERNAL BUTTON EDGES
number_slider_26 = Slider(0, range=0..1)
eval_17 = EvaluateCurve(Curve=offset_3, Parameter=number_slider_26)  # -> Point, Tangent, Angle
eval_18 = EvaluateCurve(Curve=offset_3, Parameter=Slider(0.97, range=0..1))  # -> Point, Tangent, Angle
eval_19 = EvaluateCurve(Curve=cluster.curve_result, Parameter=Slider(0, range=0..1))  # -> Point, Tangent, Angle
eval_20 = EvaluateCurve(Curve=cluster.curve_result, Parameter=Slider(1, range=0..1))  # -> Point, Tangent, Angle
ln = Line(StartPoint=eval_20.Point, EndPoint=eval_18.Point)
ln_2 = Line(StartPoint=eval_19.Point, EndPoint=eval_17.Point)
flatten = FlattenTree(Tree=eval_13.Point, Path="{0}")
flatten_2 = FlattenTree(Tree=eval_17.Point, Path="{0}")
flatten_3 = FlattenTree(Tree=eval_14.Point, Path="{0}")
flatten_4 = FlattenTree(Tree=eval_18.Point, Path="{0}")
xy_13 = XYPlane(Origin=Point(0, 0, 0))
xy_14 = XYPlane(Origin=Point(0, 0, 0))
cluster_16 = Cluster(
    reference_plane=xy_13,
    point_1=flatten_2,
    control_direction_1=cluster_3.point_1_tangent_vector,
    point_1_tangency_condition=Slider(-1, range=-1..1),
    point_1_tangency_weight=multiplication_13,
    point_2=flatten,
    control_direction_2=cluster_3.point_2_tangent_vector,
    point_2_tangency_condition=Slider(-1, range=-1..1),
    point_2_tangency_weight=multiplication_14)  # -> curve_result, point_1_4, point_1_tangent_vector, point_2_2, point_2_tangent_vector
cluster_17 = Cluster(
    reference_plane=xy_14,
    point_1=flatten_4,
    control_direction_1=cluster_4.point_1_tangent_vector,
    point_1_tangency_condition=Slider(-1, range=-1..1),
    point_1_tangency_weight=multiplication_12,
    point_2=flatten_3,
    control_direction_2=cluster_4.point_2_tangent_vector,
    point_2_tangency_condition=Slider(-1, range=-1..1),
    point_2_tangency_weight=multiplication_15)  # -> curve_result, point_1_4, point_1_tangent_vector, point_2_2, point_2_tangent_vector

# ----
# INTERNAL LEFT WING BLEND
flatten_5 = FlattenTree(Tree=eval_13.Point, Path="{0}")
flatten_6 = FlattenTree(Tree=eval_13.Point, Path="{0}")
multiplication_38 = Multiplication(A=multiplication_21, B=Slider(0.92, range=0..1))
multiplication_39 = Multiplication(A=multiplication_20, B=Slider(0.7, range=0..1))
multiplication_40 = Multiplication(A=multiplication_18, B=Slider(1, range=0..1))
multiplication_41 = Multiplication(A=multiplication_19, B=Slider(0.9, range=0..1))
xy_15 = XYPlane(Origin=Point(0, 0, 0))
xy_16 = XYPlane(Origin=Point(0, 0, 0))
cluster_18 = Cluster(
    reference_plane=xy_15,
    point_1=item_19,
    control_direction_1=cluster_8.point_1_tangent_vector,
    point_1_tangency_condition=Slider(-1, range=-1..1),
    point_1_tangency_weight=multiplication_39,
    point_2=flatten_5,
    control_direction_2=cluster_8.point_2_tangent_vector,
    point_2_tangency_condition=Slider(-1, range=-1..1),
    point_2_tangency_weight=multiplication_38)  # -> curve_result, point_1_4, point_1_tangent_vector, point_2_2, point_2_tangent_vector
cluster_19 = Cluster(
    reference_plane=xy_16,
    point_1=flatten_6,
    control_direction_1=cluster_6.point_1_tangent_vector,
    point_1_tangency_condition=Slider(-1, range=-1..1),
    point_1_tangency_weight=multiplication_41,
    point_2=item_20,
    control_direction_2=cluster_6.point_2_tangent_vector,
    point_2_tangency_condition=Slider(-1, range=-1..1),
    point_2_tangency_weight=multiplication_40)  # -> curve_result, point_1_4, point_1_tangent_vector, point_2_2, point_2_tangent_vector

# ----
# INTERNAL RIGHT WING BLEND
number_slider_27 = Slider(0.57, range=0..1)
flatten_7 = FlattenTree(Tree=eval_14.Point, Path="{0}")
flatten_8 = FlattenTree(Tree=eval_14.Point, Path="{0}")
multiplication_42 = Multiplication(A=multiplication_25, B=number_slider_27)
multiplication_43 = Multiplication(A=multiplication_24, B=Slider(0.21, range=0..1))
multiplication_44 = Multiplication(A=multiplication_16, B=Slider(0.86, range=0..1))
multiplication_45 = Multiplication(A=multiplication_17, B=Slider(0.57, range=0..1))
xy_17 = XYPlane(Origin=Point(0, 0, 0))
xy_18 = XYPlane(Origin=Point(0, 0, 0))
cluster_20 = Cluster(
    reference_plane=xy_17,
    point_1=flatten_7,
    control_direction_1=cluster_7.point_1_tangent_vector,
    point_1_tangency_condition=Slider(-1, range=-1..1),
    point_1_tangency_weight=multiplication_44,
    point_2=item_21,
    control_direction_2=cluster_7.point_2_tangent_vector,
    point_2_tangency_condition=Slider(-1, range=-1..1),
    point_2_tangency_weight=multiplication_45)  # -> curve_result, point_1_4, point_1_tangent_vector, point_2_2, point_2_tangent_vector
cluster_21 = Cluster(
    reference_plane=xy_18,
    point_1=flatten_8,
    control_direction_1=cluster_10.point_1_tangent_vector,
    point_1_tangency_condition=Slider(-1, range=-1..1),
    point_1_tangency_weight=multiplication_43,
    point_2=item_22,
    control_direction_2=cluster_10.point_2_tangent_vector,
    point_2_tangency_condition=Slider(-1, range=-1..1),
    point_2_tangency_weight=multiplication_42)  # -> curve_result, point_1_4, point_1_tangent_vector, point_2_2, point_2_tangent_vector

flatten_9 = FlattenTree(Tree=eval_18.Point, Path="{0}")
multiplication_46 = Multiplication(A=multiplication_28, B=Slider(0.26, range=0..1))
multiplication_47 = Multiplication(A=multiplication_29, B=Slider(0.76, range=0..1))
cluster_22 = Cluster(
    reference_plane=xy,
    point_1=flatten_9,
    control_direction_1=cluster_12.point_1_tangent_vector,
    point_1_tangency_condition=Slider(-1, range=-1..1),
    point_1_tangency_weight=multiplication_46,
    point_2=eval_15.Point,
    control_direction_2=cluster_12.point_2_tangent_vector,
    point_2_tangency_condition=Slider(-1, range=-1..1),
    point_2_tangency_weight=multiplication_47)  # -> curve_result, point_1_4, point_1_tangent_vector, point_2_2, point_2_tangent_vector
crv_cp_2 = CurveClosestPoint(Point=pcx.Points, Curve=cluster_16.curve_result)  # -> Point, Parameter, Distance
flatten_10 = FlattenTree(Tree=crv_cp_2.Point, Path="{0}")
shatter_3 = Shatter(Curve=cluster_16.curve_result, Parameters=crv_cp_2.Parameter)
flatten_11 = FlattenTree(Tree=eval_16.Point, Path="{0}")
multiplication_48 = Multiplication(A=multiplication_32, B=Slider(0.42, range=0..1))
multiplication_49 = Multiplication(A=multiplication_33, B=Slider(0.85, range=0..1))

# ----
# TRIANGLE FILLS
number_slider_28 = Slider(1, range=0..1)
eval_21 = EvaluateCurve(Curve=reparameterize(move_2.Geometry), Parameter=number_slider_28)  # -> Point, Tangent, Angle
eval_22 = EvaluateCurve(Curve=reparameterize(move_2.Geometry), Parameter=Slider(0, range=0..1))  # -> Point, Tangent, Angle
ln_3 = Line(StartPoint=eval_16.Point, EndPoint=eval_22.Point)
ln_4 = Line(StartPoint=eval_11.Point, EndPoint=eval_15.Point)
ln_5 = Line(StartPoint=eval_21.Point, EndPoint=eval_11.Point)
ln_6 = Line(StartPoint=eval_21.Point, EndPoint=eval_15.Point)
ln_7 = Line(StartPoint=eval_12.Point, EndPoint=eval_16.Point)
ln_8 = Line(StartPoint=eval_12.Point, EndPoint=eval_22.Point)

item_28 = ListItem(List=shatter_3, Index=Slider(1, range=0..1), Wrap=True)
item_29 = ListItem(List=shatter_3, Index=Slider(0, range=0..1), Wrap=True)
cluster_23 = Cluster(
    reference_plane=xy_2,
    point_1=flatten_11,
    control_direction_1=cluster_14.point_1_tangent_vector,
    point_1_tangency_condition=Slider(-1, range=-1..1),
    point_1_tangency_weight=multiplication_49,
    point_2=flatten_10,
    control_direction_2=cluster_14.point_2_tangent_vector,
    point_2_tangency_condition=Slider(-1, range=-1..1),
    point_2_tangency_weight=multiplication_48)  # -> curve_result, point_1_4, point_1_tangent_vector, point_2_2, point_2_tangent_vector
ln_9 = Line(StartPoint=pcx.Points, EndPoint=crv_cp_2.Point)

md_slider_5 = MDSlider(
    SliderMode=0,
    slider_value=Point(0.1224514101, 0.2442865139, 0.5),
    x_domain=Domain(0, 1),
    y_domain=Domain(0, 1),
    z_domain=Domain(0, 1))
md_slider_6 = MDSlider(
    SliderMode=0,
    slider_value=Point(0.1433641387, 0.2005645008, 0.5),
    x_domain=Domain(0, 1),
    y_domain=Domain(0, 1),
    z_domain=Domain(0, 1))
md_slider_7 = MDSlider(
    SliderMode=0,
    slider_value=Point(0.1975752668, 0.599261028, 0.5),
    x_domain=Domain(0, 1),
    y_domain=Domain(0, 1),
    z_domain=Domain(0, 1))
md_slider_8 = MDSlider(
    SliderMode=0,
    slider_value=Point(0.1315977515, 0.7156297637, 0.5),
    x_domain=Domain(0, 1),
    y_domain=Domain(0, 1),
    z_domain=Domain(0, 1))
md_slider_9 = MDSlider(
    SliderMode=0,
    slider_value=Point(0.8021389101, 0.7101425543, 0.5),
    x_domain=Domain(0, 1),
    y_domain=Domain(0, 1),
    z_domain=Domain(0, 1))
md_slider_10 = MDSlider(
    SliderMode=0,
    slider_value=Point(0.8544445503, 0.4746808308, 0.5),
    x_domain=Domain(0, 1),
    y_domain=Domain(0, 1),
    z_domain=Domain(0, 1))
md_slider_11 = MDSlider(
    SliderMode=0,
    slider_value=Point(0.3311023247, 0.9325784823, 0.5),
    x_domain=Domain(0, 1),
    y_domain=Domain(0, 1),
    z_domain=Domain(0, 1))
md_slider_12 = MDSlider(
    SliderMode=0,
    slider_value=Point(0.3311023247, 0.9325784823, 0.5),
    x_domain=Domain(0, 1),
    y_domain=Domain(0, 1),
    z_domain=Domain(0, 1))
evalsrf_4 = EvaluateSurface(Surface=reparameterize(edgesrf_6), Point=md_slider_9)  # -> Point, Normal, UDirection, VDirection, Frame
evalsrf_5 = EvaluateSurface(Surface=edgesrf, Point=md_slider_8)  # -> Point, Normal, UDirection, VDirection, Frame
evalsrf_6 = EvaluateSurface(Surface=edgesrf, Point=md_slider_5)  # -> Point, Normal, UDirection, VDirection, Frame
evalsrf_7 = EvaluateSurface(Surface=edgesrf_2, Point=md_slider_6)  # -> Point, Normal, UDirection, VDirection, Frame
evalsrf_8 = EvaluateSurface(Surface=edgesrf_2, Point=md_slider_10)  # -> Point, Normal, UDirection, VDirection, Frame
evalsrf_9 = EvaluateSurface(Surface=edgesrf_2, Point=md_slider_7)  # -> Point, Normal, UDirection, VDirection, Frame
evalsrf_10 = EvaluateSurface(Surface=reparameterize(edgesrf_3), Point=md_slider_11)  # -> Point, Normal, UDirection, VDirection, Frame
evalsrf_11 = EvaluateSurface(Surface=reparameterize(edgesrf_4), Point=md_slider_12)  # -> Point, Normal, UDirection, VDirection, Frame
number_slider_29 = Slider(4, range=0..50)
multiplication_50 = Multiplication(A=evalsrf_6.Normal, B=number_slider_29)
multiplication_51 = Multiplication(A=evalsrf_9.Normal, B=number_slider_29)
multiplication_52 = Multiplication(A=evalsrf_4.Normal, B=number_slider_29)
multiplication_53 = Multiplication(A=evalsrf_5.Normal, B=number_slider_29)
multiplication_54 = Multiplication(A=evalsrf_7.Normal, B=number_slider_29)
multiplication_55 = Multiplication(A=evalsrf_8.Normal, B=number_slider_29)
multiplication_56 = Multiplication(A=evalsrf_10.Normal, B=number_slider_29)
multiplication_57 = Multiplication(A=evalsrf_11.Normal, B=Slider(10, range=0..50))
addition_17 = Addition(A=evalsrf_6.Point, B=multiplication_50)
addition_18 = Addition(A=evalsrf_9.Point, B=multiplication_51)
addition_19 = Addition(A=evalsrf_4.Point, B=multiplication_52)
addition_20 = Addition(A=evalsrf_5.Point, B=multiplication_53)
addition_21 = Addition(A=evalsrf_7.Point, B=multiplication_54)
addition_22 = Addition(A=evalsrf_8.Point, B=multiplication_55)
addition_23 = Addition(A=evalsrf_10.Point, B=multiplication_56)
addition_24 = Addition(A=evalsrf_11.Point, B=multiplication_57)
ln_10 = Line(StartPoint=addition_21, EndPoint=addition_18)
ln_11 = Line(StartPoint=addition_18, EndPoint=addition_22)
ln_12 = Line(StartPoint=addition_21, EndPoint=addition_22)
ln_13 = Line(StartPoint=addition_22, EndPoint=addition_23)
ln_14 = Line(StartPoint=addition_19, EndPoint=addition_23)
ln_15 = Line(StartPoint=addition_17, EndPoint=addition_21)
ln_16 = Line(StartPoint=addition_20, EndPoint=addition_18)
pull = PullCurve(Curve=ln_16, Surface=[edgesrf_2, edgesrf])
pull_2 = PullCurve(Curve=ln_14, Surface=flatten([edgesrf_6, edgesrf_3]))
pull_3 = PullCurve(Curve=ln_10, Surface=[edgesrf_2, edgesrf])
pull_4 = PullCurve(Curve=ln_12, Surface=[edgesrf_2, edgesrf])
pull_5 = PullCurve(Curve=ln_11, Surface=[edgesrf_2, edgesrf])
pull_6 = PullCurve(Curve=ln_13, Surface=[edgesrf_2, edgesrf_3])
pull_7 = PullCurve(Curve=ln_15, Surface=[edgesrf_2, edgesrf])
len = Length(Curve=pull_3)
len_2 = Length(Curve=pull_4)
len_3 = Length(Curve=pull_5)
len_4 = Length(Curve=pull_2)
len_5 = Length(Curve=pull_6)
len_6 = Length(Curve=pull)
yz_3 = YZPlane(Origin=Point(0, 0, 0))
len_7 = Length(Curve=pull_7)
nullrep = ReplaceNulls(Items=len_6, Replacements=Slider(0, range=0..100))  # -> Items, Count
yz_4 = YZPlane(Origin=Point(0, 0, 0))
offset_5 = OffsetCurve(Curve=pull, Distance=Slider(15, range=0..20), Plane=yz_3, Corners=1)  # -> flatten(Curve)
nullrep_2 = ReplaceNulls(Items=len, Replacements=Slider(0, range=0..100))  # -> Items, Count
xy_19 = XYPlane(Origin=Point(0, 0, 0))
nullrep_3 = ReplaceNulls(Items=len_4, Replacements=Slider(0, range=0..100))  # -> Items, Count
nullrep_4 = ReplaceNulls(Items=len_2, Replacements=Slider(0, range=0..100))  # -> Items, Count
nullrep_5 = ReplaceNulls(Items=len_5, Replacements=Slider(0, range=0..100))  # -> Items, Count
nullrep_6 = ReplaceNulls(Items=len_3, Replacements=Slider(0, range=0..100))  # -> Items, Count
nullrep_7 = ReplaceNulls(Items=len_7, Replacements=Slider(0, range=0..100))  # -> Items, Count
offset_6 = OffsetCurve(Curve=pull_7, Distance=Slider(10, range=0..12), Plane=yz_4, Corners=1)  # -> flatten(Curve)
ma = MassAddition(Input=nullrep.Items)  # -> Result, PartialResults
ma_2 = MassAddition(Input=nullrep_3.Items)  # -> Result, PartialResults
ma_3 = MassAddition(Input=nullrep_2.Items)  # -> Result, PartialResults
ma_4 = MassAddition(Input=nullrep_5.Items)  # -> Result, PartialResults
ma_5 = MassAddition(Input=nullrep_4.Items)  # -> Result, PartialResults
offset_7 = OffsetCurve(Curve=pull_2, Distance=Slider(15, range=0..20), Plane=xy_19, Corners=1)  # -> flatten(Curve)
ma_6 = MassAddition(Input=nullrep_6.Items)  # -> Result, PartialResults
len_8 = Length(Curve=offset_5)
ma_7 = MassAddition(Input=nullrep_7.Items)  # -> Result, PartialResults
len_9 = Length(Curve=offset_6)
nullrep_8 = ReplaceNulls(Items=len_8, Replacements=Slider(0, range=0..100))  # -> Items, Count
len_10 = Length(Curve=offset_7)
nullrep_9 = ReplaceNulls(Items=len_9, Replacements=Slider(0, range=0..100))  # -> Items, Count
nullrep_10 = ReplaceNulls(Items=len_10, Replacements=Slider(0, range=0..100))  # -> Items, Count
pdecon_2 = Deconstruct(Point=evalsrf_8.Point)  # -> XComponent, YComponent, ZComponent
nullrep_11 = ReplaceNulls(Items=nullrep_10.Items, Replacements=Slider(0, range=0..100))  # -> Items, Count
addition_25 = Addition(A=Slider(-40, range=-40..40), B=pdecon_2.YComponent)
addition_26 = Addition(A=Slider(0.33, range=-30..30), B=pdecon_2.XComponent)
addition_27 = Addition(A=Slider(-9.73, range=-30..30), B=pdecon_2.ZComponent)
ma_8 = MassAddition(Input=nullrep_11.Items)  # -> Result, PartialResults
pt_26 = ConstructPoint(XCoordinate=addition_26, YCoordinate=addition_25, ZCoordinate=addition_27)
item_30 = ListItem(List=offset_6, Index=0, Wrap=True)
eval_23 = EvaluateCurve(Curve=reparameterize(item_30), Parameter=Slider(1, range=0..1))  # -> Point, Tangent, Angle
vec2pt_15 = Vector2Pt(PointA=eval_23.Point, PointB=pt_26, Unitize=False)  # -> Vector, Length
vec_28 = VectorXYZ(XComponent=Slider(0, range=0..100), YComponent=Slider(-1, range=-1..0), ZComponent=Slider(0, range=0..100))  # -> Vector, Length
multiplication_58 = Multiplication(A=vec2pt_15.Length, B=Slider(0.49, range=0..1))
vec2pt_16 = Vector2Pt(PointA=addition_24, PointB=pt_26, Unitize=False)  # -> Vector, Length
xy_20 = XYPlane(Origin=Point(0, 0, 0))
cluster_24 = Cluster(
    reference_plane=xy_20,
    point_1=eval_23.Point,
    control_direction_1=eval_23.Tangent,
    point_1_tangency_condition=Slider(-1, range=-1..1),
    point_1_tangency_weight=multiplication_58,
    point_2=pt_26,
    point_2_tangency_condition=Slider(-1, range=-1..1),
    point_2_tangency_weight=Slider(0, range=0..50))  # -> curve_result, point_1_4, point_1_tangent_vector, point_2_2, point_2_tangent_vector
multiplication_59 = Multiplication(A=vec2pt_16.Length, B=Slider(0.65, range=0..1))
xy_21 = XYPlane(Origin=Point(0, 0, 0))
cluster_25 = Cluster(
    reference_plane=xy_21,
    point_1=addition_24,
    control_direction_1=vec_28.Vector,
    point_1_tangency_condition=Slider(-1, range=-1..1),
    point_1_tangency_weight=multiplication_59,
    point_2=pt_26,
    point_2_tangency_condition=Slider(-1, range=-1..1),
    point_2_tangency_weight=Slider(0, range=0..50))  # -> curve_result, point_1_4, point_1_tangent_vector, point_2_2, point_2_tangent_vector
ma_9 = MassAddition(Input=nullrep_8.Items)  # -> Result, PartialResults
ma_10 = MassAddition(Input=nullrep_9.Items)  # -> Result, PartialResults
len_11 = Length(Curve=cluster_24.curve_result)
len_12 = Length(Curve=cluster_25.curve_result)
number_slider_30 = Slider(0, range=0..100)
merge_13 = Merge(
    Data1=ma_8.Result,
    Data2=ma_9.Result,
    Data3=ma_10.Result,
    Data4=number_slider_30,
    Data5=number_slider_30,
    Data6=number_slider_30,
    Data7=len_11,
    Data8=len_12)
graph = QuickGraph([merge_2, merge_13], SortOrder=0)

edgesrf_9 = EdgeSurface(CurveA=offset_3, CurveB=cluster_17.curve_result, CurveC=offset_2, CurveD=cluster_16.curve_result)

# ----
# RIGHT CLEARANCE BODY
number_slider_31 = Slider(0.85, range=0..1)
flatten_12 = FlattenTree(Tree=offset_3, Path="{0}")
addition_28 = Addition(A=Slider(0.03, range=0..1), B=number_slider_31)
eval_24 = EvaluateCurve(Curve=cluster.curve_result, Parameter=addition_28)  # -> Point, Tangent, Angle
eval_25 = EvaluateCurve(Curve=cluster_2.curve_result, Parameter=addition_28)  # -> Point, Tangent, Angle
eval_26 = EvaluateCurve(Curve=cluster.curve_result, Parameter=number_slider_31)  # -> Point, Tangent, Angle
eval_27 = EvaluateCurve(Curve=cluster_2.curve_result, Parameter=number_slider_31)  # -> Point, Tangent, Angle
xy_22 = XYPlane(Origin=Point(0, 0, 0))
xy_23 = XYPlane(Origin=Point(0, 0, 0))
cluster_26 = Cluster(
    reference_plane=xy_22,
    point_1=eval_24.Point,
    control_direction_1=cluster_4.point_1_tangent_vector,
    point_1_tangency_condition=Slider(-1, range=-1..1),
    point_1_tangency_weight=multiplication_12,
    point_2=eval_25.Point,
    control_direction_2=cluster_4.point_2_tangent_vector,
    point_2_tangency_condition=Slider(-1, range=-1..1),
    point_2_tangency_weight=multiplication_15)  # -> curve_result, point_1_4, point_1_tangent_vector, point_2_2, point_2_tangent_vector
cluster_27 = Cluster(
    reference_plane=xy_23,
    point_1=eval_26.Point,
    control_direction_1=cluster_4.point_1_tangent_vector,
    point_1_tangency_condition=Slider(-1, range=-1..1),
    point_1_tangency_weight=multiplication_12,
    point_2=eval_27.Point,
    control_direction_2=cluster_4.point_2_tangent_vector,
    point_2_tangency_condition=Slider(-1, range=-1..1),
    point_2_tangency_weight=multiplication_15)  # -> curve_result, point_1_4, point_1_tangent_vector, point_2_2, point_2_tangent_vector
merge_14 = Merge(Data1=addition_28, Data2=number_slider_31)
shatter_4 = Shatter(Curve=cluster.curve_result, Parameters=merge_14)
crv_cp_3 = CurveClosestPoint(Point=eval_25.Point, Curve=offset_2)  # -> flatten(Point), Parameter, Distance
crv_cp_4 = CurveClosestPoint(Point=eval_26.Point, Curve=flatten_12)  # -> flatten(Point), Parameter, Distance
crv_cp_5 = CurveClosestPoint(Point=eval_27.Point, Curve=offset_2)  # -> flatten(Point), Parameter, Distance
crv_cp_6 = CurveClosestPoint(Point=eval_24.Point, Curve=flatten_12)  # -> flatten(Point), Parameter, Distance
number_slider_32 = Slider(0.85, range=0..1)
project = Project(Curve=cluster_27.curve_result, Brep=edgesrf, Direction=Vector(0, 0, 1))  # -> reparameterize(Curve)
project_2 = Project(Curve=cluster_26.curve_result, Brep=edgesrf, Direction=Vector(0, 0, 1))  # -> reparameterize(Curve)
xy_24 = XYPlane(Origin=Point(0, 0, 0))
xy_25 = XYPlane(Origin=Point(0, 0, 0))
item_31 = ListItem(List=shatter_4, Index=Slider(1, range=0..2), Wrap=True)
cluster_28 = Cluster(
    reference_plane=xy_24,
    point_1=crv_cp_4.Point,
    control_direction_1=cluster_4.point_1_tangent_vector,
    point_1_tangency_condition=Slider(-1, range=-1..1),
    point_1_tangency_weight=multiplication_12,
    point_2=crv_cp_5.Point,
    control_direction_2=cluster_4.point_2_tangent_vector,
    point_2_tangency_condition=Slider(-1, range=-1..1),
    point_2_tangency_weight=multiplication_15)  # -> curve_result, point_1_4, point_1_tangent_vector, point_2_2, point_2_tangent_vector
cluster_29 = Cluster(
    reference_plane=xy_25,
    point_1=crv_cp_6.Point,
    control_direction_1=cluster_4.point_1_tangent_vector,
    point_1_tangency_condition=Slider(-1, range=-1..1),
    point_1_tangency_weight=multiplication_12,
    point_2=crv_cp_3.Point,
    control_direction_2=cluster_4.point_2_tangent_vector,
    point_2_tangency_condition=Slider(-1, range=-1..1),
    point_2_tangency_weight=multiplication_15)  # -> curve_result, point_1_4, point_1_tangent_vector, point_2_2, point_2_tangent_vector
eval_28 = EvaluateCurve(Curve=project, Parameter=number_slider_32)  # -> Point, Tangent, Angle
eval_29 = EvaluateCurve(Curve=project_2, Parameter=number_slider_32)  # -> Point, Tangent, Angle
shatter_5 = Shatter(Curve=project_2, Parameters=number_slider_32)
shatter_6 = Shatter(Curve=project, Parameters=number_slider_32)
ln_17 = Line(StartPoint=eval_29.Point, EndPoint=eval_28.Point)
merge_15 = Merge(Data1=crv_cp_4.Parameter, Data2=crv_cp_6.Parameter)
shatter_7 = Shatter(Curve=flatten_12, Parameters=merge_15)
item_32 = ListItem(List=shatter_5, Index=Slider(0, range=0..2), Wrap=True)
item_33 = ListItem(List=shatter_6, Index=Slider(0, range=0..2), Wrap=True)
project_3 = Project(Curve=cluster_29.curve_result, Brep=edgesrf_9, Direction=Vector(0, 0, 1))  # -> reparameterize(Curve)
project_4 = Project(Curve=cluster_28.curve_result, Brep=edgesrf_9, Direction=Vector(0, 0, 1))  # -> reparameterize(Curve)
item_34 = ListItem(List=shatter_7, Index=Slider(1, range=0..2), Wrap=True)
eval_30 = EvaluateCurve(Curve=project_3, Parameter=number_slider_32)  # -> Point, Tangent, Angle
eval_31 = EvaluateCurve(Curve=project_4, Parameter=number_slider_32)  # -> Point, Tangent, Angle
shatter_8 = Shatter(Curve=project_4, Parameters=number_slider_32)
shatter_9 = Shatter(Curve=project_3, Parameters=number_slider_32)
ln_18 = Line(StartPoint=eval_31.Point, EndPoint=eval_30.Point)
item_35 = ListItem(List=shatter_8, Index=Slider(0, range=0..2), Wrap=True)
item_36 = ListItem(List=shatter_9, Index=Slider(0, range=0..2), Wrap=True)
flip = FlipCurve(Curve=ln_17, Guide=ln_18)  # -> Curve, Flag
edgesrf_10 = EdgeSurface(CurveA=item_31, CurveB=item_34)
edgesrf_11 = EdgeSurface(CurveA=item_32, CurveB=item_36)
edgesrf_12 = EdgeSurface(CurveA=item_33, CurveB=item_35)
edgesrf_13 = EdgeSurface(CurveA=item_31, CurveB=item_32, CurveC=ln_17, CurveD=item_33)
merge_16 = Merge(Data1=flip.Curve, Data2=ln_18)
edgesrf_14 = EdgeSurface(CurveA=item_34, CurveB=item_35, CurveC=ln_18, CurveD=item_36)
loft_3 = Loft(Curves=merge_16, Options={Adjust=False, Closed=False, LoftEnds=0, LoftSimp=0, LoftType=0, Rebuild=10, Refit=0.01})
number_slider_33 = Slider(3, range=-3..3)
neg_2 = Negative(Value=number_slider_33)
merge_17 = Merge(Data1=edgesrf_13, Data2=edgesrf_10, Data3=edgesrf_11, Data4=loft_3, Data5=edgesrf_12, Data6=edgesrf_14)  # -> flatten(Result)
Z_3 = UnitZ(Factor=neg_2)
Z_4 = UnitZ(Factor=number_slider_33)
join_4 = BrepJoin(Breps=merge_17)  # -> Breps, Closed
extr_3 = Extrude(Base=edgesrf_13, Direction=Z_4)
extr_4 = Extrude(Base=edgesrf_14, Direction=Z_3)
debrep_7 = DeconstructBrep(Brep=extr_4)  # -> Faces, Edges, Vertices
debrep_8 = DeconstructBrep(Brep=extr_3)  # -> Faces, Edges, Vertices
Y = UnitY(Factor=Slider(3, range=-3..3))
item_37 = ListItem(List=debrep_7.Faces, Index=Slider(4, range=0..5), Wrap=True)
item_38 = ListItem(List=debrep_8.Faces, Index=Slider(4, range=0..5), Wrap=True)
merge_18 = Merge(Data1=item_38, Data2=item_37, Data3=edgesrf_10)  # -> flatten(Result)
extr_5 = Extrude(Base=merge_18, Direction=Y)
merge_19 = Merge(Data1=join_4.Breps, Data2=extr_5, Data3=extr_4, Data4=extr_3)  # -> flatten(Result)
sunion = SolidUnion(Breps=merge_19)

# ----
# LEFT CLEARANCE BODY
number_slider_34 = Slider(0.08, range=0..1)
flatten_13 = FlattenTree(Tree=offset_3, Path="{0}")
addition_29 = Addition(A=Slider(0.03, range=0..1), B=number_slider_34)
eval_32 = EvaluateCurve(Curve=cluster.curve_result, Parameter=addition_29)  # -> Point, Tangent, Angle
eval_33 = EvaluateCurve(Curve=cluster_2.curve_result, Parameter=addition_29)  # -> Point, Tangent, Angle
eval_34 = EvaluateCurve(Curve=cluster.curve_result, Parameter=number_slider_34)  # -> Point, Tangent, Angle
eval_35 = EvaluateCurve(Curve=cluster_2.curve_result, Parameter=number_slider_34)  # -> Point, Tangent, Angle
xy_26 = XYPlane(Origin=Point(0, 0, 0))
xy_27 = XYPlane(Origin=Point(0, 0, 0))
cluster_30 = Cluster(
    reference_plane=xy_26,
    point_1=eval_32.Point,
    control_direction_1=cluster_3.point_1_tangent_vector,
    point_1_tangency_condition=Slider(-1, range=-1..1),
    point_1_tangency_weight=multiplication_13,
    point_2=eval_33.Point,
    control_direction_2=cluster_3.point_2_tangent_vector,
    point_2_tangency_condition=Slider(-1, range=-1..1),
    point_2_tangency_weight=multiplication_14)  # -> curve_result, point_1_4, point_1_tangent_vector, point_2_2, point_2_tangent_vector
cluster_31 = Cluster(
    reference_plane=xy_27,
    point_1=eval_34.Point,
    control_direction_1=cluster_3.point_1_tangent_vector,
    point_1_tangency_condition=Slider(-1, range=-1..1),
    point_1_tangency_weight=multiplication_13,
    point_2=eval_35.Point,
    control_direction_2=cluster_3.point_2_tangent_vector,
    point_2_tangency_condition=Slider(-1, range=-1..1),
    point_2_tangency_weight=multiplication_14)  # -> curve_result, point_1_4, point_1_tangent_vector, point_2_2, point_2_tangent_vector
merge_20 = Merge(Data1=addition_29, Data2=number_slider_34)
shatter_10 = Shatter(Curve=cluster.curve_result, Parameters=merge_20)
crv_cp_7 = CurveClosestPoint(Point=eval_33.Point, Curve=offset_2)  # -> flatten(Point), Parameter, Distance
crv_cp_8 = CurveClosestPoint(Point=eval_34.Point, Curve=flatten_13)  # -> flatten(Point), Parameter, Distance
crv_cp_9 = CurveClosestPoint(Point=eval_35.Point, Curve=offset_2)  # -> flatten(Point), Parameter, Distance
crv_cp_10 = CurveClosestPoint(Point=eval_32.Point, Curve=flatten_13)  # -> flatten(Point), Parameter, Distance
number_slider_35 = Slider(0.85, range=0..1)
project_5 = Project(Curve=cluster_31.curve_result, Brep=edgesrf, Direction=Vector(0, 0, 1))  # -> reparameterize(Curve)
project_6 = Project(Curve=cluster_30.curve_result, Brep=edgesrf, Direction=Vector(0, 0, 1))  # -> reparameterize(Curve)
xy_28 = XYPlane(Origin=Point(0, 0, 0))
xy_29 = XYPlane(Origin=Point(0, 0, 0))
item_39 = ListItem(List=shatter_10, Index=Slider(1, range=0..2), Wrap=True)
cluster_32 = Cluster(
    reference_plane=xy_28,
    point_1=crv_cp_8.Point,
    control_direction_1=cluster_3.point_1_tangent_vector,
    point_1_tangency_condition=Slider(-1, range=-1..1),
    point_1_tangency_weight=multiplication_13,
    point_2=crv_cp_9.Point,
    control_direction_2=cluster_3.point_2_tangent_vector,
    point_2_tangency_condition=Slider(-1, range=-1..1),
    point_2_tangency_weight=multiplication_14)  # -> curve_result, point_1_4, point_1_tangent_vector, point_2_2, point_2_tangent_vector
cluster_33 = Cluster(
    reference_plane=xy_29,
    point_1=crv_cp_10.Point,
    control_direction_1=cluster_3.point_1_tangent_vector,
    point_1_tangency_condition=Slider(-1, range=-1..1),
    point_1_tangency_weight=multiplication_13,
    point_2=crv_cp_7.Point,
    control_direction_2=cluster_3.point_2_tangent_vector,
    point_2_tangency_condition=Slider(-1, range=-1..1),
    point_2_tangency_weight=multiplication_14)  # -> curve_result, point_1_4, point_1_tangent_vector, point_2_2, point_2_tangent_vector
eval_36 = EvaluateCurve(Curve=project_5, Parameter=number_slider_35)  # -> Point, Tangent, Angle
eval_37 = EvaluateCurve(Curve=project_6, Parameter=number_slider_35)  # -> Point, Tangent, Angle
shatter_11 = Shatter(Curve=project_6, Parameters=number_slider_35)
shatter_12 = Shatter(Curve=project_5, Parameters=number_slider_35)
ln_19 = Line(StartPoint=eval_37.Point, EndPoint=eval_36.Point)
merge_21 = Merge(Data1=crv_cp_8.Parameter, Data2=crv_cp_10.Parameter)
shatter_13 = Shatter(Curve=flatten_13, Parameters=merge_21)
item_40 = ListItem(List=shatter_11, Index=Slider(0, range=0..2), Wrap=True)
item_41 = ListItem(List=shatter_12, Index=Slider(0, range=0..2), Wrap=True)
project_7 = Project(Curve=cluster_33.curve_result, Brep=edgesrf_9, Direction=Vector(0, 0, 1))  # -> reparameterize(Curve)
project_8 = Project(Curve=cluster_32.curve_result, Brep=edgesrf_9, Direction=Vector(0, 0, 1))  # -> reparameterize(Curve)
item_42 = ListItem(List=shatter_13, Index=Slider(1, range=0..2), Wrap=True)
eval_38 = EvaluateCurve(Curve=project_7, Parameter=number_slider_35)  # -> Point, Tangent, Angle
eval_39 = EvaluateCurve(Curve=project_8, Parameter=number_slider_35)  # -> Point, Tangent, Angle
shatter_14 = Shatter(Curve=project_8, Parameters=number_slider_35)
shatter_15 = Shatter(Curve=project_7, Parameters=number_slider_35)
ln_20 = Line(StartPoint=eval_39.Point, EndPoint=eval_38.Point)
edgesrf_15 = EdgeSurface(CurveA=item_39, CurveB=item_40, CurveC=ln_19, CurveD=item_41)
item_43 = ListItem(List=shatter_14, Index=Slider(0, range=0..2), Wrap=True)
item_44 = ListItem(List=shatter_15, Index=Slider(0, range=0..2), Wrap=True)
edgesrf_16 = EdgeSurface(CurveA=ln_19, CurveB=ln_20)
edgesrf_17 = EdgeSurface(CurveA=item_39, CurveB=item_42)
edgesrf_18 = EdgeSurface(CurveA=item_40, CurveB=item_44)
edgesrf_19 = EdgeSurface(CurveA=item_41, CurveB=item_43)
edgesrf_20 = EdgeSurface(CurveA=item_42, CurveB=item_43, CurveC=ln_20, CurveD=item_44)
number_slider_36 = Slider(3, range=-3..3)
neg_3 = Negative(Value=number_slider_36)
merge_22 = Merge(Data1=edgesrf_15, Data2=edgesrf_17, Data3=edgesrf_18, Data4=edgesrf_16, Data5=edgesrf_19, Data6=edgesrf_20)  # -> flatten(Result)
Y_2 = UnitY(Factor=number_slider_36)
Z_5 = UnitZ(Factor=neg_3)
Z_6 = UnitZ(Factor=number_slider_36)
join_5 = BrepJoin(Breps=merge_22)  # -> Breps, Closed
extr_6 = Extrude(Base=edgesrf_15, Direction=Z_6)
extr_7 = Extrude(Base=edgesrf_17, Direction=Y_2)
extr_8 = Extrude(Base=edgesrf_20, Direction=Z_5)
merge_23 = Merge(Data1=extr_6, Data2=join_5.Breps, Data3=extr_8, Data4=extr_7)  # -> flatten(Result)
sunion_2 = SolidUnion(Breps=merge_23)

edgesrf_21 = EdgeSurface(CurveA=cluster_17.curve_result, CurveB=cluster_22.curve_result, CurveC=item_27, CurveD=cluster_21.curve_result)
edgesrf_22 = EdgeSurface(CurveA=cluster_23.curve_result, CurveB=item_28, CurveC=cluster_18.curve_result, CurveD=item_23)
edgesrf_23 = EdgeSurface(CurveA=cluster_18.curve_result, CurveB=cluster_19.curve_result, CurveC=item_24)
edgesrf_24 = EdgeSurface(CurveA=offset_2, CurveB=cluster_20.curve_result, CurveC=item_25, CurveD=cluster_19.curve_result)
edgesrf_25 = EdgeSurface(CurveA=cluster_21.curve_result, CurveB=item_26, CurveC=cluster_20.curve_result)
edgesrf_26 = EdgeSurface(CurveA=cluster_14.curve_result, CurveB=ln_9, CurveC=cluster_23.curve_result, CurveD=ln_7)
edgesrf_27 = EdgeSurface(CurveA=ln_4, CurveB=ln_5, CurveC=ln_6)
edgesrf_28 = EdgeSurface(CurveA=ln_7, CurveB=ln_8, CurveC=ln_3)
edgesrf_29 = EdgeSurface(CurveA=ln, CurveB=cluster_12.curve_result, CurveC=ln_4, CurveD=cluster_22.curve_result)
edgesrf_30 = EdgeSurface(CurveA=cluster.curve_result, CurveB=ln, CurveC=ln_2, CurveD=offset_3)
edgesrf_31 = EdgeSurface(CurveA=ln_2, CurveB=item_11, CurveC=ln_9, CurveD=item_29)

# ----
# CAPPING SURFACES
merge_24 = Merge(
    Data1=edgesrf_30,
    Data2=edgesrf_26,
    Data3=edgesrf_28,
    Data4=edgesrf_29,
    Data5=edgesrf_27,
    Data6=edgesrf_31,
    Data7=loft_2,
    Data8=loft)

# ----
# INTERNAL SURFACES
merge_25 = Merge(Data1=edgesrf_9, Data2=edgesrf_22, Data3=edgesrf_23, Data4=edgesrf_24, Data5=edgesrf_25, Data6=edgesrf_21)

# ----
# MOUSE WHEEL CLEARANCE BODY
md_slider_13 = MDSlider(
    SliderMode=0,
    slider_value=Point(0.4925150057, 0.4213629002, 0.5),
    x_domain=Domain(0, 1),
    y_domain=Domain(0, 1),
    z_domain=Domain(0, 1))
pt_27 = Point(Point(0.45, 0.475, 0))
pdecon_3 = Deconstruct(Point=pt_27)  # -> XComponent, YComponent, ZComponent
addition_30 = Addition(A=pdecon_3.XComponent, B=Slider(-0.02, range=-0.5..0.5))
number_slider_37 = Slider(-39, range=-70..70)
number_slider_38 = Slider(-0.962, range=-50..75)
number_slider_39 = Slider(10.73, range=0..45)
pt_28 = ConstructPoint(XCoordinate=addition_30, YCoordinate=pdecon_3.YComponent, ZCoordinate=pdecon_3.ZComponent)
number_slider_40 = Slider(-13.235, range=-70..70)
number_slider_41 = Slider(4.8, range=-50..75)
number_slider_42 = Slider(10.73, range=0..45)
evalsrf_12 = EvaluateSurface(Surface=reparameterize(edgesrf), Point=pt_27)  # -> Point, Normal, UDirection, VDirection, Frame
evalsrf_13 = EvaluateSurface(Surface=reparameterize(edgesrf), Point=pt_28)  # -> Point, Normal, UDirection, VDirection, Frame
neg_4 = Negative(Value=number_slider_37)
pl_2 = PlaneNormal(Origin=evalsrf_12.Point, ZAxis=evalsrf_12.Normal)
neg_5 = Negative(Value=number_slider_40)
pl_3 = PlaneNormal(Origin=evalsrf_13.Point, ZAxis=evalsrf_13.Normal)
addition_31 = Addition(A=neg_4, B=Slider(70, range=-70..70))
neg_6 = Negative(Value=number_slider_38)
neg_7 = Negative(Value=number_slider_39)
addition_32 = Addition(A=neg_5, B=Slider(0, range=-70..70))
neg_8 = Negative(Value=number_slider_41)
neg_9 = Negative(Value=number_slider_42)
pt_29 = PointOriented(BasePlane=pl_2, UComponent=number_slider_37, VComponent=number_slider_38, WComponent=number_slider_39)
pt_30 = PointOriented(BasePlane=pl_2, UComponent=addition_31, VComponent=neg_6, WComponent=neg_7)
pt_31 = PointOriented(BasePlane=pl_3, UComponent=number_slider_40, VComponent=number_slider_41, WComponent=number_slider_42)
pt_32 = PointOriented(BasePlane=pl_3, UComponent=addition_32, VComponent=neg_8, WComponent=neg_9)
box = Box2Pt(PointA=pt_31, PointB=pt_32, Plane=pl_3)
box_2 = Box2Pt(PointA=pt_29, PointB=pt_30, Plane=pl_2)
merge_26 = Merge(Data1=box_2, Data2=box)
sunion_3 = SolidUnion(Breps=merge_26)

merge_27 = Merge(Data1=merge_12, Data2=merge_24, Data3=merge_25)  # -> flatten(Result)
join_6 = BrepJoin(Breps=merge_27)  # -> Breps, Closed
panel_12 = Panel(merge_13)

# ----
# CLEARANCE CUTS
sdiff = SolidDifference(BrepsA=join_6.Breps, BrepsB=sunion_2)
sdiff_2 = SolidDifference(BrepsA=sdiff, BrepsB=sunion)
sdiff_3 = SolidDifference(BrepsA=sdiff_2, BrepsB=sunion_3)

# ----
# EXTRACT ORIENTATION OF MOUSE BUTTONS
pflip = FlipPlane(Plane=pl_3, ReverseX=False, ReverseY=True, SwapAxes=True)
deplane = DeconstructPlane(Plane=pflip)  # -> Origin, XAxis, YAxis, ZAxis
pl_4 = ConstructPlane(Origin=Point(0, 0, 0), XAxis=deplane.XAxis, YAxis=deplane.YAxis)
pdecon_4 = Deconstruct(Point=deplane.ZAxis)  # -> XComponent, YComponent, ZComponent
pt_33 = Point(Point(0, 0, 0))
pt_34 = ConstructPoint(XCoordinate=pdecon_4.XComponent, YCoordinate=pdecon_4.YComponent, ZCoordinate=pdecon_4.ZComponent)
ln_21 = Line(StartPoint=pt_33, EndPoint=deplane.ZAxis)
pt_35 = Point(Point(0, 0, 0))
xy_30 = XYPlane(Origin=Point(0, 0, 0))
vdis = VectorDisplay(Anchor=pt_35, Vector=deplane.ZAxis)
project_9 = ProjectPoint(Point=pt_34, Direction=Vector(0, 0, -1), Geometry=xy_30)  # -> Point, Index
pdecon_5 = Deconstruct(Point=project_9.Point)  # -> XComponent, YComponent, ZComponent
vec_29 = VectorXYZ(XComponent=pdecon_5.XComponent, YComponent=pdecon_5.YComponent, ZComponent=pdecon_5.ZComponent)  # -> Vector, Length
Y_3 = UnitY(Factor=1)
xy_31 = XYPlane(Origin=Point(0, 0, 0))
angle = Angle(VectorA=vec_29.Vector, VectorB=Y_3)  # -> Angle, Reflex
neg_10 = Negative(Value=angle.Angle)
vdis_2 = VectorDisplay(Anchor=pt_35, Vector=vec_29.Vector)
prot = RotatePlane(Plane=xy_31, Angle=neg_10)
angle_2 = Angle(VectorA=vec_29.Vector, VectorB=deplane.ZAxis)  # -> Angle, Reflex
deplane_2 = DeconstructPlane(Plane=prot)  # -> Origin, XAxis, YAxis, ZAxis
subtraction_2 = Subtraction(A=angle_2.Angle, B=Slider(1.571, range=0..10))
vrot = Rotate(Vector=deplane_2.YAxis, Axis=deplane_2.XAxis, Angle=subtraction_2)
pl_5 = ConstructPlane(Origin=Point(0, 0, 0), XAxis=deplane_2.XAxis, YAxis=vrot)
angle_3 = Angle(VectorA=deplane.YAxis, VectorB=vrot, Plane=pl_5)  # -> Angle, Reflex

# ----
# FRONT WEDGE
number_slider_43 = Slider(2, range=0..55)
item_45 = ListItem(List=debrep_2.Faces, Index=number_slider_43, Wrap=True)
pt_36 = PointOriented(BasePlane=item_45, UComponent=0, VComponent=0, WComponent=0)
devec_5 = DeconstructVector(Vector=pt_36)  # -> XComponent, YComponent, ZComponent
number_slider_44 = Slider(0.93, range=0..1)
eval_40 = EvaluateCurve(Curve=reparameterize(offset_4), Parameter=number_slider_44)  # -> Point, Tangent, Angle
eval_41 = EvaluateCurve(Curve=reparameterize(offset_4), Parameter=Slider(0, range=0..1))  # -> Point, Tangent, Angle
devec_6 = DeconstructVector(Vector=eval_41.Point)  # -> XComponent, YComponent, ZComponent
subtraction_3 = Subtraction(A=devec_6.YComponent, B=devec_5.YComponent, C=Slider(2, range=0..5))
Y_4 = UnitY(Factor=subtraction_3)
extr_9 = Extrude(Base=item_45, Direction=Y_4)
debrep_9 = DeconstructBrep(Brep=extr_9)  # -> Faces, Edges, Vertices
item_46 = ListItem(List=debrep_9.Edges, Index=Slider(10, range=0..15), Wrap=True)
flip_2 = FlipCurve(Curve=item_46)  # -> reparameterize(Curve), Flag
item_47 = ListItem(List=debrep_9.Faces, Index=Slider(1, range=0..15), Wrap=True)
shatter_16 = Shatter(Curve=offset_4, Parameters=number_slider_44)
eval_42 = EvaluateCurve(Curve=reparameterize(flip_2.Curve), Parameter=number_slider_44)  # -> Point, Tangent, Angle
eval_43 = EvaluateCurve(Curve=reparameterize(flip_2.Curve), Parameter=Slider(0, range=0..1))  # -> Point, Tangent, Angle
item_48 = ListItem(List=shatter_16, Index=0, Wrap=True)
shatter_17 = Shatter(Curve=flip_2.Curve, Parameters=number_slider_44)
X = UnitX(Factor=Slider(5, range=0..5))
item_49 = ListItem(List=shatter_17, Index=0, Wrap=True)
extr_10 = Extrude(Base=item_47, Direction=X)
debrep_10 = DeconstructBrep(Brep=extr_10)  # -> Faces, Edges, Vertices
ln_22 = Line(StartPoint=eval_41.Point, EndPoint=eval_43.Point)
ln_23 = Line(StartPoint=eval_40.Point, EndPoint=eval_42.Point)
item_50 = ListItem(List=debrep_10.Faces, Index=Slider(4, range=0..15), Wrap=True)
edgesrf_32 = EdgeSurface(CurveA=item_48, CurveB=ln_22, CurveC=item_49, CurveD=ln_23)
Z_7 = UnitZ(Factor=Slider(5.25, range=0..15))
extr_11 = Extrude(Base=item_50, Direction=Z_7)
Y_5 = UnitY(Factor=Slider(-6.29, range=-10..0))
extr_12 = Extrude(Base=edgesrf_32, Direction=Y_5)

# ----
# ALIGN PCB CLICKER TO MOUSE
# BUTTONS AND MOVE
Z_8 = UnitZ(Factor=1)
xy_32 = XYPlane(Origin=Point(0, 0, 0))
neg_11 = Negative(Value=angle.Angle)
pl_6 = ConstructPlane(Origin=Point(0, 0, 0), XAxis=Z_8, YAxis=vec_29.Vector)
rotate_5 = Rotate(Geometry=rotate_4.Geometry, Angle=neg_11, Plane=xy_32)  # -> Geometry, Transform
neg_12 = Negative(Value=angle_2.Angle)
rotate_6 = Rotate(Geometry=rotate_5.Geometry, Angle=neg_12, Plane=pl_6)  # -> Geometry, Transform
rotax = RotateAxis(Geometry=rotate_6.Geometry, Angle=angle_3.Reflex, Axis=ln_21)  # -> Geometry, Transform
deplane_3 = DeconstructPlane(Plane=pflip)  # -> Origin, XAxis, YAxis, ZAxis
multiplication_60 = Multiplication(A=deplane_3.XAxis, B=Slider(0.3, range=-10..10))
multiplication_61 = Multiplication(A=Slider(0, range=-10..110), B=deplane_3.YAxis)
multiplication_62 = Multiplication(A=Slider(-17.46, range=-50..50), B=deplane_3.ZAxis)
addition_33 = Addition(A=deplane_3.Origin, B=multiplication_60, C=multiplication_61, D=multiplication_62)
move_3 = Move(Geometry=rotax.Geometry, Motion=addition_33)  # -> Geometry, Transform

# ----
# MICROSWITCH STANDOFFS
number_slider_45 = Slider(2, range=0..2)
item_51 = ListItem(List=move_3.Geometry, Index=number_slider_45, Wrap=True)
debrep_11 = DeconstructBrep(Brep=item_51)  # -> Faces, Edges, Vertices
item_52 = ListItem(List=debrep_11.Faces, Index=Slider(21, range=0..52), Wrap=True)
item_53 = ListItem(List=debrep_11.Faces, Index=Slider(16, range=0..52), Wrap=True)
pt_37 = Point(Point(0.5, 0.5, 0))
pt_38 = Point(Point(0.5, 0.5, 0))
evalsrf_14 = EvaluateSurface(Surface=item_52, Point=pt_38)  # -> Point, Normal, UDirection, VDirection, Frame
evalsrf_15 = EvaluateSurface(Surface=item_53, Point=pt_37)  # -> Point, Normal, UDirection, VDirection, Frame
multiplication_63 = Multiplication(A=evalsrf_14.Normal, B=Slider(0.7, range=-10..10))
multiplication_64 = Multiplication(A=evalsrf_15.Normal, B=Slider(0.7, range=-10..10))
extr_13 = Extrude(Base=item_52, Direction=multiplication_63)
extr_14 = Extrude(Base=item_53, Direction=multiplication_64)
debrep_12 = DeconstructBrep(Brep=extr_14)  # -> Faces, Edges, Vertices
debrep_13 = DeconstructBrep(Brep=extr_13)  # -> Faces, Edges, Vertices
item_54 = ListItem(List=debrep_12.Faces, Index=Slider(5, range=0..6), Wrap=True)
item_55 = ListItem(List=debrep_13.Faces, Index=Slider(5, range=0..6), Wrap=True)
multiplication_65 = Multiplication(A=evalsrf_15.Normal, B=Slider(7.1, range=-10..10))
multiplication_66 = Multiplication(A=evalsrf_14.Normal, B=Slider(7.1, range=-10..10))
extr_15 = Extrude(Base=item_54, Direction=multiplication_65)
extr_16 = Extrude(Base=item_55, Direction=multiplication_66)
debrep_14 = DeconstructBrep(Brep=extr_16)  # -> Faces, Edges, Vertices
debrep_15 = DeconstructBrep(Brep=extr_15)  # -> Faces, Edges, Vertices
item_56 = ListItem(List=debrep_14.Faces, Index=Slider(1, range=0..6), Wrap=True)
item_57 = ListItem(List=debrep_15.Faces, Index=Slider(2, range=0..6), Wrap=True)
pt_39 = Point(Point(0.5, 0.5, 0))
pt_40 = Point(Point(0.5, 0.5, 0))
evalsrf_16 = EvaluateSurface(Surface=reparameterize(item_57), Point=pt_39)  # -> Point, Normal, UDirection, VDirection, Frame
evalsrf_17 = EvaluateSurface(Surface=reparameterize(item_56), Point=pt_40)  # -> Point, Normal, UDirection, VDirection, Frame
scale_nu = ScaleNU(Geometry=extr_15, Plane=evalsrf_16.Frame, ScaleX=1, ScaleY=1, ScaleZ=Slider(0.5, range=-10..10))  # -> Geometry, Transform
scale_nu_2 = ScaleNU(Geometry=extr_16, Plane=evalsrf_17.Frame, ScaleX=1, ScaleY=1, ScaleZ=Slider(0.5, range=-10..10))  # -> Geometry, Transform
debrep_16 = DeconstructBrep(Brep=scale_nu.Geometry)  # -> Faces, Edges, Vertices
debrep_17 = DeconstructBrep(Brep=scale_nu_2.Geometry)  # -> Faces, Edges, Vertices
item_58 = ListItem(List=debrep_16.Faces, Index=Slider(5, range=0..6), Wrap=True)
item_59 = ListItem(List=debrep_17.Faces, Index=Slider(5, range=0..6), Wrap=True)
pt_41 = Point(Point(0.5, 0.5, 0))
pt_42 = Point(Point(0.5, 0.5, 0))
evalsrf_18 = EvaluateSurface(Surface=reparameterize(item_58), Point=pt_41)  # -> Point, Normal, UDirection, VDirection, Frame
evalsrf_19 = EvaluateSurface(Surface=reparameterize(item_59), Point=pt_42)  # -> Point, Normal, UDirection, VDirection, Frame
scale_nu_3 = ScaleNU(Geometry=scale_nu.Geometry, Plane=evalsrf_18.Frame, ScaleX=1, ScaleY=1, ScaleZ=Slider(0.85, range=-10..10))  # -> Geometry, Transform
scale_nu_4 = ScaleNU(Geometry=scale_nu_2.Geometry, Plane=evalsrf_19.Frame, ScaleX=1, ScaleY=1, ScaleZ=Slider(0.85, range=-10..10))  # -> Geometry, Transform
volume = Volume(Geometry=scale_nu_3.Geometry)  # -> Volume, Centroid
volume_2 = Volume(Geometry=scale_nu_4.Geometry)  # -> Volume, Centroid
pl_7 = PlaneNormal(Origin=volume.Centroid, ZAxis=evalsrf_16.Normal)
pl_8 = PlaneNormal(Origin=volume_2.Centroid, ZAxis=evalsrf_17.Normal)
align = AlignPlanes(Planes=pl_7, Master=evalsrf_16.Frame)
align_2 = AlignPlanes(Planes=pl_8, Master=evalsrf_17.Frame)
number_slider_46 = Slider(0.55, range=-1..1)
number_slider_47 = Slider(0.55, range=-1..1)
scale_nu_5 = ScaleNU(Geometry=scale_nu_3.Geometry, Plane=align, ScaleX=1, ScaleY=number_slider_46, ScaleZ=number_slider_46)  # -> Geometry, Transform
scale_nu_6 = ScaleNU(Geometry=scale_nu_4.Geometry, Plane=align_2, ScaleX=1, ScaleY=number_slider_47, ScaleZ=number_slider_47)  # -> Geometry, Transform
addition_34 = Addition(A=number_slider_46, B=Slider(0.15, range=0..1))
addition_35 = Addition(A=number_slider_47, B=Slider(0.15, range=0..1))
scale_nu_7 = ScaleNU(Geometry=scale_nu_3.Geometry, Plane=align, ScaleX=1, ScaleY=addition_34, ScaleZ=addition_34)  # -> Geometry, Transform
scale_nu_8 = ScaleNU(Geometry=scale_nu_4.Geometry, Plane=align_2, ScaleX=1, ScaleY=addition_35, ScaleZ=addition_35)  # -> Geometry, Transform
sdiff_4 = SolidDifference(BrepsA=scale_nu.Geometry, BrepsB=scale_nu_7.Geometry)
sdiff_5 = SolidDifference(BrepsA=scale_nu_2.Geometry, BrepsB=scale_nu_8.Geometry)
merge_28 = Merge(Data1=sdiff_4, Data2=sdiff_5)
merge_29 = Merge(Data1=scale_nu_5.Geometry, Data2=scale_nu_6.Geometry)

# ----
# PCB CLICKER ATTACHMENT ARMS
number_slider_48 = Slider(2, range=0..2)
cull_i = CullIndex(List=move_3.Geometry, Indices=number_slider_48, Wrap=True)
item_60 = ListItem(List=cull_i, Index=0, Wrap=True)  # -> Item, Item1
debrep_18 = DeconstructBrep(Brep=item_60.Item1)  # -> Faces, Edges, Vertices
debrep_19 = DeconstructBrep(Brep=item_60.Item)  # -> Faces, Edges, Vertices
item_61 = ListItem(List=debrep_18.Faces, Index=Slider(4, range=0..15), Wrap=True)
pt_43 = Point(Point(0.5, 0.5, 0))
item_62 = ListItem(List=debrep_19.Faces, Index=Slider(4, range=0..15), Wrap=True)
evalsrf_20 = EvaluateSurface(Surface=reparameterize(item_61), Point=pt_43)  # -> Point, Normal, UDirection, VDirection, Frame
pt_44 = Point(Point(0.5, 0.5, 0))
evalsrf_21 = EvaluateSurface(Surface=reparameterize(item_62), Point=pt_44)  # -> Point, Normal, UDirection, VDirection, Frame
multiplication_67 = Multiplication(A=evalsrf_20.Normal, B=Slider(10, range=0..10))
multiplication_68 = Multiplication(A=evalsrf_21.Normal, B=Slider(3, range=0..10))
extr_17 = Extrude(Base=item_61, Direction=multiplication_67)
extr_18 = Extrude(Base=item_62, Direction=multiplication_68)
sdiff_6 = SolidDifference(BrepsA=extr_17, BrepsB=join_6.Breps)
debrep_20 = DeconstructBrep(Brep=extr_18)  # -> Faces, Edges, Vertices
item_63 = ListItem(List=sdiff_6, Index=0, Wrap=True)
item_64 = ListItem(List=debrep_20.Faces, Index=Slider(2, range=0..15), Wrap=True)
pt_45 = Point(Point(0.5, 0.5, 0))
evalsrf_22 = EvaluateSurface(Surface=reparameterize(item_64), Point=pt_45)  # -> Point, Normal, UDirection, VDirection, Frame
multiplication_69 = Multiplication(A=evalsrf_22.Normal, B=Slider(17.165, range=0..20))
extr_19 = Extrude(Base=item_64, Direction=multiplication_69)
merge_30 = Merge(Data1=extr_19, Data2=extr_18, Data3=sdiff_3, Data4=item_63, Data5=cull_i)  # -> flatten(Result)

sdiff_7 = SolidDifference(BrepsA=extr_11, BrepsB=sdiff_3)
item_65 = ListItem(List=sdiff_7, Index=0, Wrap=True)

# ----
# PERPENDICULAR STANDS
number_slider_49 = Slider(59, range=0..65)
xz_2 = XZPlane(Origin=Point(0, 0, 0))
sec = BrepPlane(Brep=edgesrf_22, Plane=xz_2)  # -> Curves, Points
item_66 = ListItem(List=debrep.Faces, Index=number_slider_49, Wrap=True)
item_67 = ListItem(List=debrep.Faces, Index=Slider(17, range=0..45), Wrap=True)
yz_5 = YZPlane(Origin=Point(0, 0, 0))
item_68 = ListItem(List=debrep.Faces, Index=Slider(18, range=0..45), Wrap=True)
yz_6 = YZPlane(Origin=Point(0, 0, 0))
x_tremez = Extremes(Curve=cluster_21.curve_result, Plane=yz_5)  # -> Highest, Lowest
pt_46 = PointOriented(BasePlane=item_66, UComponent=0, VComponent=0, WComponent=0)
x_tremez_2 = Extremes(Curve=sec.Curves, Plane=yz_6)  # -> Highest, Lowest
pt_47 = PointOriented(BasePlane=item_68, UComponent=0, VComponent=0, WComponent=0)
pdecon_6 = Deconstruct(Point=pt_46)  # -> XComponent, YComponent, ZComponent
pdecon_7 = Deconstruct(Point=x_tremez.Lowest)  # -> XComponent, YComponent, ZComponent
pdecon_8 = Deconstruct(Point=pt_47)  # -> XComponent, YComponent, ZComponent
pdecon_9 = Deconstruct(Point=x_tremez_2.Highest)  # -> XComponent, YComponent, ZComponent
subtraction_4 = Subtraction(A=pdecon_7.XComponent, B=pdecon_6.XComponent, C=Slider(2.4, range=-4..4))
subtraction_5 = Subtraction(A=pdecon_9.XComponent, B=pdecon_8.XComponent, C=Slider(-2.4, range=-4..4))
X_2 = UnitX(Factor=subtraction_4)
Y_6 = UnitY(Factor=Slider(-5.2, range=-20..20))
X_3 = UnitX(Factor=subtraction_5)
extr_20 = Extrude(Base=item_66, Direction=X_2)
extr_21 = Extrude(Base=item_67, Direction=Y_6)
extr_22 = Extrude(Base=item_68, Direction=X_3)
debrep_21 = DeconstructBrep(Brep=extr_20)  # -> Faces, Edges, Vertices
debrep_22 = DeconstructBrep(Brep=extr_22)  # -> Faces, Edges, Vertices
debrep_23 = DeconstructBrep(Brep=extr_21)  # -> Faces, Edges, Vertices
item_69 = ListItem(List=debrep_21.Faces, Index=Slider(5, range=0..45), Wrap=True)
item_70 = ListItem(List=debrep_22.Faces, Index=Slider(5, range=0..45), Wrap=True)
item_71 = ListItem(List=debrep_23.Faces, Index=Slider(5, range=0..45), Wrap=True)
X_4 = UnitX(Factor=Slider(7.1, range=-20..20))
X_5 = UnitX(Factor=Slider(-10.1, range=-20..20))
extr_23 = Extrude(Base=item_69, Direction=X_4)
extr_24 = Extrude(Base=item_70, Direction=X_5)
Y_7 = UnitY(Factor=Slider(-12, range=-20..20))
debrep_24 = DeconstructBrep(Brep=extr_23)  # -> Faces, Edges, Vertices
debrep_25 = DeconstructBrep(Brep=extr_24)  # -> Faces, Edges, Vertices
extr_25 = Extrude(Base=item_71, Direction=Y_7)
debrep_26 = DeconstructBrep(Brep=extr_25)  # -> Faces, Edges, Vertices
item_72 = ListItem(List=debrep_24.Faces, Index=Slider(4, range=0..45), Wrap=True)
item_73 = ListItem(List=debrep_25.Faces, Index=Slider(4, range=0..12), Wrap=True)
item_74 = ListItem(List=debrep_26.Faces, Index=Slider(4, range=0..45), Wrap=True)
Z_9 = UnitZ(Factor=Slider(26.7, range=-20..50))
Z_10 = UnitZ(Factor=Slider(30, range=-20..30))
Z_11 = UnitZ(Factor=Slider(36.3, range=-20..50))
extr_26 = Extrude(Base=item_72, Direction=Z_9)
extr_27 = Extrude(Base=item_74, Direction=Z_10)
extr_28 = Extrude(Base=item_73, Direction=Z_11)
sdiff_8 = SolidDifference(BrepsA=extr_26, BrepsB=sdiff_3)
sdiff_9 = SolidDifference(BrepsA=extr_28, BrepsB=sdiff_3)
sdiff_10 = SolidDifference(BrepsA=extr_27, BrepsB=sdiff_3)
item_75 = ListItem(List=sdiff_8, Index=0, Wrap=True)  # -> Item, Item1
item_76 = ListItem(List=sdiff_9, Index=1, Wrap=True)  # -> Item, Item1
item_77 = ListItem(List=sdiff_10, Index=0, Wrap=True)
merge_31 = Merge(Data1=item_65, Data2=item_77, Data3=item_76.Item1, Data4=item_75.Item)

# ----
# BASE PCB FIXTURE
merge_32 = Merge(Data1=extr_25, Data2=extr_24, Data3=extr_23, Data4=extr_10)
merge_33 = Merge(Data1=extr_21, Data2=extr_22, Data3=extr_20)
sdiff_11 = SolidDifference(BrepsA=merge_32, BrepsB=sdiff_3)
merge_34 = Merge(Data1=merge_33, Data2=sdiff_11, Data3=move.Geometry, Data4=extr_12, Data5=extr_9)  # -> flatten(Result)
sunion_4 = SolidUnion(Breps=merge_34)

# ----
# MASS FIXTURES
number_slider_50 = Slider(-14.2, range=-70..70)
number_slider_51 = Slider(21.5, range=-40..40)
number_slider_52 = Slider(-21, range=-171..170)
addition_36 = Addition(A=number_slider_50, B=19)
subtraction_6 = Subtraction(A=number_slider_51, B=0.5)
pt_48 = ConstructPoint(XCoordinate=number_slider_50, YCoordinate=number_slider_52, ZCoordinate=subtraction_6)
pt_49 = ConstructPoint(XCoordinate=addition_36, YCoordinate=number_slider_52, ZCoordinate=subtraction_6)
pt_50 = ConstructPoint(XCoordinate=addition_36, YCoordinate=number_slider_52, ZCoordinate=number_slider_51)
pt_51 = ConstructPoint(XCoordinate=number_slider_50, YCoordinate=number_slider_52, ZCoordinate=number_slider_51)
xy_33 = XYPlane(Origin=pt_48)
xy_34 = XYPlane(Origin=pt_49)
number_slider_53 = Slider(0.95, range=0..5)
xy_35 = XYPlane(Origin=pt_50)
number_slider_54 = Slider(2.5, range=0..5)
number_slider_55 = Slider(8.2, range=0..9)
xy_36 = XYPlane(Origin=pt_51)
addition_37 = Addition(A=number_slider_55, B=1)
cyl = Cylinder(Base=xy_35, Radius=number_slider_54, Length=number_slider_55)
cyl_2 = Cylinder(Base=xy_36, Radius=number_slider_54, Length=number_slider_55)
cyl_3 = Cylinder(Base=xy_33, Radius=number_slider_53, Length=addition_37)
cyl_4 = Cylinder(Base=xy_34, Radius=number_slider_53, Length=addition_37)
cap = CapHoles(Brep=cyl_2)
cap_2 = CapHoles(Brep=cyl)
number_slider_56 = Slider(3, range=0..10)
cap_3 = CapHoles(Brep=cyl_3)
cap_4 = CapHoles(Brep=cyl_4)
addition_38 = Addition(A=number_slider_55, B=number_slider_51, C=number_slider_56)
merge_35 = Merge(Data1=cap, Data2=cap_2)
merge_36 = Merge(Data1=cap_3, Data2=cap_4)
pt_52 = ConstructPoint(XCoordinate=number_slider_50, YCoordinate=number_slider_52, ZCoordinate=addition_38)
pt_53 = ConstructPoint(XCoordinate=addition_36, YCoordinate=number_slider_52, ZCoordinate=addition_38)
ln_24 = Line(StartPoint=pt_52, EndPoint=pt_53)
midpt = CurveMiddle(Curve=ln_24)
xy_37 = XYPlane(Origin=midpt)
box_3 = CenterBox(Base=xy_37, X=Slider(16.5, range=0..50), Y=Slider(8, range=0..50), Z=number_slider_56)
merge_37 = Merge(Data1=merge_35, Data2=box_3)
sunion_5 = SolidUnion(Breps=merge_37)
sdiff_12 = SolidDifference(BrepsA=sunion_5, BrepsB=merge_36)
rotate_7 = Rotate(Geometry=sdiff_12, Angle=1.570796327, Plane=xy_37)  # -> Geometry, Transform
debrep_27 = DeconstructBrep(Brep=rotate_7.Geometry)  # -> Faces, Edges, Vertices
item_78 = ListItem(List=debrep_27.Vertices, Index=Slider(0, range=0..60), Wrap=True)
project_10 = ProjectPoint(Point=item_78, Direction=Vector(0, 1, 0), Geometry=edgesrf_24)  # -> Point, Index
pdecon_10 = Deconstruct(Point=item_78)  # -> XComponent, YComponent, ZComponent
pdecon_11 = Deconstruct(Point=project_10.Point)  # -> XComponent, YComponent, ZComponent
number_slider_57 = Slider(13.87, range=0..30)
subtraction_7 = Subtraction(A=pdecon_11.YComponent, B=pdecon_10.YComponent)
vec_30 = VectorXYZ(XComponent=Slider(0, range=0..30), YComponent=subtraction_7, ZComponent=Slider(0, range=0..30))  # -> Vector, Length
move_4 = Move(Geometry=rotate_7.Geometry, Motion=vec_30.Vector)  # -> Geometry, Transform
debrep_28 = DeconstructBrep(Brep=move_4.Geometry)  # -> Faces, Edges, Vertices
item_79 = ListItem(List=debrep_28.Faces, Index=Slider(5, range=0..60), Wrap=True)
Z_12 = UnitZ(Factor=Slider(13, range=0..60))
extr_29 = Extrude(Base=item_79, Direction=Z_12)
merge_38 = Merge(Data1=extr_29, Data2=move_4.Geometry)  # -> flatten(Result)
sunion_6 = SolidUnion(Breps=merge_38)
sdiff_13 = SolidDifference(BrepsA=sunion_6, BrepsB=join_6.Breps)
item_80 = ListItem(List=sdiff_13, Index=0, Wrap=True)  # -> Item, Item1

area = Area(Geometry=item_50)  # -> Area, Centroid
area_2 = Area(Geometry=item_72)  # -> Area, Centroid
area_3 = Area(Geometry=item_74)  # -> Area, Centroid
area_4 = Area(Geometry=item_73)  # -> Area, Centroid
devec_7 = DeconstructVector(Vector=area.Centroid)  # -> XComponent, YComponent, ZComponent
devec_8 = DeconstructVector(Vector=area_2.Centroid)  # -> XComponent, YComponent, ZComponent
devec_9 = DeconstructVector(Vector=area_4.Centroid)  # -> XComponent, YComponent, ZComponent
devec_10 = DeconstructVector(Vector=area_3.Centroid)  # -> XComponent, YComponent, ZComponent

# ----
# HOLE CYLINDERS
number_slider_58 = Slider(20.6, range=-70..70)
number_slider_59 = Slider(-22.5, range=-171..170)
number_slider_60 = Slider(-5.8, range=-70..70)
number_slider_61 = Slider(-37.4, range=-171..170)
number_slider_62 = Slider(-32, range=-70..70)
number_slider_63 = Slider(-21, range=-171..170)
number_slider_64 = Slider(-0.1, range=-70..70)
pt_54 = ConstructPoint(XCoordinate=devec_9.XComponent, YCoordinate=devec_9.YComponent, ZCoordinate=number_slider_64)
pt_55 = ConstructPoint(XCoordinate=devec_10.XComponent, YCoordinate=devec_10.YComponent, ZCoordinate=number_slider_64)
pt_56 = ConstructPoint(XCoordinate=devec_7.XComponent, YCoordinate=devec_7.YComponent, ZCoordinate=number_slider_64)
pt_57 = ConstructPoint(XCoordinate=devec_8.XComponent, YCoordinate=devec_8.YComponent, ZCoordinate=number_slider_64)
xy_38 = XYPlane(Origin=pt_54)
number_slider_65 = Slider(1.1, range=0..3)
xy_39 = XYPlane(Origin=pt_55)
number_slider_66 = Slider(9, range=0..9)
xy_40 = XYPlane(Origin=pt_56)
xy_41 = XYPlane(Origin=pt_57)
cyl_5 = Cylinder(Base=xy_38, Radius=number_slider_65, Length=number_slider_66)
cyl_6 = Cylinder(Base=xy_39, Radius=number_slider_65, Length=number_slider_66)
cyl_7 = Cylinder(Base=xy_40, Radius=number_slider_65, Length=number_slider_66)
cyl_8 = Cylinder(Base=xy_41, Radius=number_slider_65, Length=number_slider_66)
cap_5 = CapHoles(Brep=cyl_8)
cap_6 = CapHoles(Brep=cyl_5)
cap_7 = CapHoles(Brep=cyl_6)
cap_8 = CapHoles(Brep=cyl_7)
merge_39 = Merge(Data1=cap_5, Data2=cap_6, Data3=cap_7, Data4=cap_8)

merge_40 = Merge(Data1=merge_31, Data2=merge_30, Data3=merge_29, Data4=item_80.Item1)  # -> flatten(Result)
sunion_7 = SolidUnion(Breps=merge_40)
# BASE BODY
sdiff_14 = SolidDifference(BrepsA=sunion_4, BrepsB=merge_39)
# SHELL BODY
sdiff_15 = SolidDifference(BrepsA=sunion_7, BrepsB=merge_39)
# CLICKER INSERTS
sdiff_16 = SolidDifference(BrepsA=merge_28, BrepsB=sunion_7)

# ==== cluster ChildPlane
parent_plane = ClusterInput()
offset_vector = ClusterInput()
devec = DeconstructVector(OffsetVector=offset_vector)  # -> XComponent, YComponent, ZComponent
x_rotation = ClusterInput()
pt = PointOriented(BasePlane=parent_plane, UComponent=devec.XComponent, VComponent=devec.YComponent, WComponent=devec.ZComponent)
deplane = DeconstructPlane(Plane=parent_plane)  # -> Origin, XAxis, YAxis, ZAxis
y_rotation = ClusterInput()
z_rotation = ClusterInput()
vrot = Rotate(Vector=deplane.YAxis, Axis=deplane.XAxis, XRotation=x_rotation)
pl = ConstructPlane(Origin=pt, XAxis=deplane.XAxis, YAxis=vrot)
deplane_2 = DeconstructPlane(Plane=pl)  # -> Origin, XAxis, YAxis, ZAxis
vrot_2 = Rotate(Vector=deplane_2.XAxis, Axis=deplane_2.YAxis, YRotation=y_rotation)
pl_2 = ConstructPlane(Origin=deplane_2.Origin, XAxis=vrot_2, YAxis=deplane_2.YAxis)
prot = RotatePlane(Plane=pl_2, ZRotation=z_rotation)
resultant_plane = ClusterOutput(prot)

# ==== cluster Cluster
point_1 = ClusterInput()
point_2 = ClusterInput()
pdecon = Deconstruct(Point1=point_1)  # -> XComponent, YComponent, ZComponent
pdecon_2 = Deconstruct(Point2=point_2)  # -> XComponent, YComponent, ZComponent
reference_plane = ClusterInput()
control_direction_2 = ClusterInput()
control_direction_1 = ClusterInput()
addition = Addition(A=point_2, ControlDirection2=control_direction_2)
addition_2 = Addition(A=point_1, ControlDirection1=control_direction_1)
point_1_2 = PointOriented(
    ReferencePlaneP=reference_plane,
    UComponent=pdecon_2.XComponent,
    VComponent=pdecon_2.YComponent,
    WComponent=pdecon_2.ZComponent)
point_1_3 = PointOriented(
    ReferencePlaneP=reference_plane,
    UComponent=pdecon.XComponent,
    VComponent=pdecon.YComponent,
    WComponent=pdecon.ZComponent)
vec2pt = Vector2Pt(PointA=addition, PointB=point_2, Unitize=Toggle(True))  # -> Vector, Length
vec2pt_2 = Vector2Pt(PointA=addition_2, PointB=point_1, Unitize=Toggle(True))  # -> Vector, Length
point_2_tangency_condition = ClusterInput()
point_1_tangency_condition = ClusterInput()
multiplication = Multiplication(ControlVector2=vec2pt.Vector, Point2TangencyCondition=point_2_tangency_condition)
multiplication_2 = Multiplication(ControlVector1=vec2pt_2.Vector, Point1TangencyCondition=point_1_tangency_condition)
point_2_tangency_weight = ClusterInput()
point_1_tangency_weight = ClusterInput()
multiplication_3 = Multiplication(A=multiplication, Point2TangencyWeight=point_2_tangency_weight)
multiplication_4 = Multiplication(A=multiplication_2, Point1TangencyWeight=point_1_tangency_weight)
devec = DeconstructVector(Vector=multiplication_3)  # -> XComponent, YComponent, ZComponent
devec_2 = DeconstructVector(Vector=multiplication_4)  # -> XComponent, YComponent, ZComponent
addition_3 = Addition(A=pdecon_2.ZComponent, B=devec.ZComponent)
addition_4 = Addition(A=pdecon_2.YComponent, B=devec.YComponent)
addition_5 = Addition(A=pdecon_2.XComponent, B=devec.XComponent)
addition_6 = Addition(A=pdecon.ZComponent, B=devec_2.ZComponent)
addition_7 = Addition(A=pdecon.YComponent, B=devec_2.YComponent)
addition_8 = Addition(A=pdecon.XComponent, B=devec_2.XComponent)
pt = PointOriented(ReferencePlaneP=reference_plane, UComponent=addition_5, VComponent=addition_4, WComponent=addition_3)
pt_2 = PointOriented(ReferencePlaneP=reference_plane, UComponent=addition_8, VComponent=addition_7, WComponent=addition_6)
merge = Merge(Data1=point_1_3, Data2=pt_2, Data3=pt, Data4=point_1_2)
nurbs = NurbsCurve(Vertices=merge, Degree=3, Periodic=False)  # -> CurveResult, Length, Domain
curve_result = ClusterOutput(nurbs.CurveResult)
point_2_tangent_vector = ClusterOutput(multiplication)
point_1_4 = ClusterOutput(point_1)
point_2_2 = ClusterOutput(point_2)
point_1_tangent_vector = ClusterOutput(multiplication_2)
